# Grasshopper definition FacadeEmbed_JinQiao_Podium.gh (Grasshopper 1.0.7)
# plug-ins: EleFront, Wombat, Hare, Pufferfish, TT Toolbox

# ---- group: 钢结构预埋
crv = Curve([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])

# ---- group: 板槽
inblock = InsertBlock(BlockName="xxx", SourcePlane=PlaneXY(0, 0, 0))

# ----
# 单体选型
list = ValueList({"板埋": 0, "槽埋": 1, "板槽埋": 2}, selected="槽埋")
list_2 = ValueList({"顶埋": 0, "侧埋": 1}, selected="顶埋")
panel = Panel(list)
panel_2 = Panel(list_2)

# ----
# Input Curve
# 2层时内部定位点
crv_2 = Curve(<curve referenced from the Rhino model>)

# ----
# 1.输入block names
data = Data(["PX-GLAZ-F2$0$PX-GLAZ-F2$0$fin", "PX-GLAZ-F2$0$PX-GLAZ-F1$0$fin"])
panel_3 = Panel(data)

# ----
# Prep
# 区分有Plane 和 无Plane的 Block
# block names
listblockd = ListBlockDocument()
panel_5 = Panel(listblockd)
refblock = ReferenceBlockByName(BlockName=panel_3)
deblock = DeconstructBlock(Block=refblock)  # -> Name, Plane, Geometry

# ----
# 找到定位的Block&Curve
# 完成后逐个按Update按钮
# block names
# Later:
# 处理定位点不是Block的情况
# 以及定位点是Blcok、Curves与建筑线不同组合可能
listblockd_2 = ListBlockDocument()
panel_6 = Panel(listblockd_2)

# ----
# Input Blocks (have Plan-type1)
# 主体定位点
data_2 = Data(["PX-GLAZ-F2$0$PX-GLAZ-F1$0$标准块", "PX-GLAZ-F2$0$PX-GLAZ-F2$0$标准块", "PX-GLAZ-F2$0$PX-GLAZ-F3$0$标准块"])

# ----
# Input Blocks转换的Curves
# 主体定位点
crv_3 = Curve(<curve referenced from the Rhino model>)

# ---- group: 结构线
crv_4 = Curve(<curve referenced from the Rhino model>)

# ----
# 平面定位INPUT
crv_5 = Curve([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])

# ---- group: 玻璃线
玻璃线 = Curve(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)
玻璃线_2 = Curve(<curve referenced from the Rhino model>)
玻璃线_3 = Curve(<curve referenced from the Rhino model>)

# ---- group: 定位竖料
crv_6 = Curve([<curve referenced from the Rhino model> x300])
crv_7 = Curve([<curve referenced from the Rhino model> x180])
crv_8 = Curve([<curve referenced from the Rhino model> x383])

# ----
# Input Blocks (have Plan-type2)
# 主体定位点
data_3 = Data("PX-GLAZ-F2$0$T3T")

# ----
# 按图层整理curves
# 完成后逐个按Update按钮
panel_7 = Panel("Arch_curve_smooth")
reflay = ReferenceByLayer(LayerName=panel_7)
reflay_2 = ReferenceByLayer(LayerName="Arch_curve_doubleLine")
reflay_3 = ReferenceByLayer(LayerName="Arch_curve_angular_withLocation")
reflay_4 = ReferenceByLayer(LayerName="Arch_curve_angular")
reflay_5 = ReferenceByLayer(LayerName="ArchCurve_Whole")

# ----
# This Project Only
panel_8 = Panel("Arch_curve_other")
reflay_6 = ReferenceByLayer(LayerName=panel_8)

# ---- group: 混凝土
# 板埋几何INPUT
list_3 = ValueList({"C15": 0, "C20": 1, "C25": 2, "C30": 3, "C35": 4, "C40": 5}, selected="C35")

# ---- group: 钢筋牌号
list_4 = ValueList({"HPB300": 0, "HRB400": 1}, selected="HPB300")

# ---- group: 直径
list_5 = ValueList({"10": 0, "12": 1, "16": 2, "18": 3, "20": 4, "25": 5}, selected="12")

# ---- group: 列
list_6 = ValueList({"2X": 0, "3X": 1, "4X": 2}, selected="3X")

# ---- group: 行
list_7 = ValueList({"2Y": 0, "3Y": 1, "4Y": 2}, selected="2Y")

# ---- group: 锚筋间距
s_x = Slider(22, range=14..60, expression="X*5")
s_y = Slider(22, range=14..60, expression="X*5")

# ----
crv_9 = Curve([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])

layer = ObjectLayer(Guid=crv_2)  # -> LayerIndex, LayerPathName
panel_9 = Panel(layer.LayerPathName)
reflay_7 = ReferenceByLayer(LayerName=panel_9)
xy = XYPlane(Origin=Point(0, 0, 0))
project = Project(Geometry=reflay_7, Plane=xy)  # -> Geometry, Transform

panel_10 = Panel(data_2)
layer_2 = ObjectLayer(Guid=crv_3)  # -> LayerIndex, LayerPathName
panel_12 = Panel(layer_2.LayerPathName)
refblock_2 = ReferenceBlockByName(BlockName=panel_10)
reflay_8 = ReferenceByLayer(LayerName=panel_12)
xy_2 = XYPlane(Origin=Point(0, 0, 0))
xy_3 = XYPlane(Origin=Point(0, 0, 0))
project_2 = Project(Geometry=refblock_2, Plane=xy_3)  # -> Geometry, Transform
project_3 = Project(Geometry=reflay_8, Plane=xy_2)  # -> Geometry, Transform

# ----
# 槽埋-角部选择
list_8 = ValueList({"槽埋角部-L形": 0, "槽埋角部-I形": 1}, selected="槽埋角部-I形")

join = JoinCurves(Curves=crv_9, Preserve=False)
panel_13 = Panel(data_3)
xy_4 = XYPlane(Origin=Point(0, 0, 0))
xy_5 = XYPlane(Origin=Point(0, 0, 0))
xy_6 = XYPlane(Origin=Point(0, 0, 0))
xy_7 = XYPlane(Origin=Point(0, 0, 0))
xy_8 = XYPlane(Origin=Point(0, 0, 0))
xy_9 = XYPlane(Origin=Point(0, 0, 0))
flip = FlipCurve(Curve=玻璃线)  # -> Curve, Flag
boundary = BoundarySurfaces(Edges=join)
project_4 = Project(Geometry=reflay, Plane=xy_4)  # -> Geometry, Transform
project_5 = Project(Geometry=reflay_2, Plane=xy_5)  # -> Geometry, Transform
project_6 = Project(Geometry=reflay_3, Plane=xy_6)  # -> Geometry, Transform
project_7 = Project(Geometry=reflay_4, Plane=xy_7)  # -> Geometry, Transform
project_8 = Project(Geometry=reflay_5, Plane=xy_8)  # -> Geometry, Transform
project_9 = Project(Geometry=reflay_6, Plane=xy_9)  # -> Geometry, Transform

# ----
# 2.检测plane是否存在
pln = Plane(deblock.Plane)

filter = StreamFilter(Gate=Toggle(True), Stream0=玻璃线, Stream1=flip.Curve)
sunion = SolidUnion(Breps=boundary)
refblock_3 = ReferenceBlockByName(BlockName=panel_13)
crv_10 = Curve(project_5.Geometry)
crv_11 = Curve(project_6.Geometry)
crv_12 = Curve(project_4.Geometry)
crv_13 = Curve(project_7.Geometry)
crv_14 = Curve(project_8.Geometry)
offset = OffsetCurve(Curve=filter, Distance=expr("-x", Slider(375, range=0..1000)), Corners=1)
area = Area(Geometry=sunion)  # -> Area, Centroid

# ----
# 3.如果不存在则Blake geometry
# 并在rhino里面清理线段
geo = Geometry(deblock.Geometry)

pt = Point(area.Centroid)
explode = Explode(Curve=offset, Recursive=True)  # -> Segments, Vertices
xy_10 = XYPlane(Origin=Point(0, 0, 0))

# ---- group: 钢结构预埋
# 随文件数据请勿覆盖
crv_15 = Curve([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])

# ---- group: 槽埋3D
brep = Brep(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)

# ----
pt_2 = Point(explode.Vertices)
entwine = Entwine(Branch00=sunion, Branch01=pt, FlattenInputs=True)
max = Maximum(A=s_x, B=s_y)
project_10 = Project(Geometry=refblock_3, Plane=xy_10)  # -> Geometry, Transform
flip_2 = FlipMatrix(Data=entwine)
filter_2 = StreamFilter(Gate=list_3, Stream0=7.2, Stream1=9.6, Stream2=11.9, Stream3=14.3, Stream4=16.7, Stream5=19.1)
filter_3 = StreamFilter(Gate=list_4, Stream0=270, Stream1=360)
filter_4 = StreamFilter(Gate=list_5, Stream0=10, Stream1=12, Stream2=16, Stream3=18, Stream4=20, Stream5=25)
filter_5 = StreamFilter(Gate=list_3, Stream0=0.91, Stream1=1.1, Stream2=1.27, Stream3=1.43, Stream4=1.57, Stream5=1.71)
filter_6 = StreamFilter(Gate=list_4, Stream0=0.16, Stream1=0.14)
addition = Addition(A=list_6, B=1)
addition_2 = Addition(A=list_7, B=1)
division = Division(A=max, B=8)

# ----
# 测试Smooth Curve是否与每个Block相切
# remove duplicate blocks
deblock_2 = DeconstructBlock(Block=project_10.Geometry)  # -> Name, Plane, Geometry
pln_2 = Plane(flatten(deblock_2.Plane))
deplane = DeconstructPlane(Plane=pln_2)  # -> Origin, XAxis, YAxis, ZAxis
cullduppoints = RemoveDuplicatePoints(InputPoints=deplane.Origin, Tolerance=0.001)  # -> OutputPoints, FirstPointIndexes
null = NullItem(Item=cullduppoints.FirstPointIndexes)  # -> NullFlags, InvalidFlags, Description
dispatch = Dispatch(List=pln_2, DispatchPattern=null.InvalidFlags)  # -> ListA, ListB
dispatch_2 = Dispatch(List=flatten(project_10.Geometry), DispatchPattern=null.InvalidFlags)  # -> ListA, ListB
pln_3 = Plane(dispatch.ListA)

# ---- group: 建筑定位轮廓
item = ListItem(List=flip_2, Index="0", Wrap=True)  # -> flatten(Item)

# ---- group: 埋件定位点
item_2 = ListItem(List=flip_2, Index="-1", Wrap=True)  # -> flatten(Item)

# ----
t = Integer(division)

# ----
# 测试Smooth Curve是否与每个Block相切
# remove duplicate blocks
deblock_3 = DeconstructBlock(Block=project_2.Geometry)  # -> Name, Plane, Geometry
pln_4 = Plane(flatten(deblock_3.Plane))
deplane_2 = DeconstructPlane(Plane=pln_4)  # -> Origin, XAxis, YAxis, ZAxis
cullduppoints_2 = RemoveDuplicatePoints(InputPoints=deplane_2.Origin, Tolerance=0.001)  # -> OutputPoints, FirstPointIndexes
null_2 = NullItem(Item=cullduppoints_2.FirstPointIndexes)  # -> NullFlags, InvalidFlags, Description
dispatch_3 = Dispatch(List=pln_4, DispatchPattern=null_2.InvalidFlags)  # -> ListA, ListB
dispatch_4 = Dispatch(List=flatten(project_2.Geometry), DispatchPattern=null_2.InvalidFlags)  # -> ListA, ListB
pln_5 = Plane(dispatch_3.ListA)

panel_14 = Panel(filter_5)
panel_15 = Panel(filter_2)
panel_16 = Panel(filter_6)
min = Minimum(A=filter_3, B=300)
brep_2 = Brep(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)
panel_17 = Panel(min)
expression = Expression(A=filter_6, fy=filter_3, ft=filter_5, d=filter_4, Expression="(int((0.6*1.1*A*fy/ft*d)/5)+1)*5")

deblock_4 = DeconstructBlock(Block=dispatch_2.ListA)  # -> Name, Plane, Geometry
data_4 = Data(dispatch_2.ListA)

data_5 = Data(flatten(pln_3))
deplane_3 = DeconstructPlane(Plane=data_5)  # -> Origin, XAxis, YAxis, ZAxis
pln_6 = Plane(data_5)
amp = Amplitude(Vector=deplane_3.YAxis, Amplitude=Slider(300, range=0..1000))
move = Move(Geometry=deplane_3.Origin, Motion=amp)  # -> Geometry, Transform
ln = Line(StartPoint=deplane_3.Origin, EndPoint=move.Geometry)
crv_16 = Curve(crv_12)
midpt = CurveMiddle(Curve=ln)
scale = Scale(Geometry=ln, Center=midpt, Factor=Slider(7.8, range=0..10))  # -> Geometry, Transform
merge = Merge(Data1=scale.Geometry, Data2=crv_16)
mcx = MultipleCurves(Curves=flatten(merge))  # -> Points, IndexA, IndexB, ParamA, ParamB

deblock_5 = DeconstructBlock(Block=dispatch_4.ListA)  # -> Name, Plane, Geometry
data_6 = Data(dispatch_4.ListA)

data_7 = Data(flatten(pln_5))
deplane_4 = DeconstructPlane(Plane=data_7)  # -> Origin, XAxis, YAxis, ZAxis
pln_7 = Plane(data_7)
amp_2 = Amplitude(Vector=deplane_4.YAxis, Amplitude=Slider(300, range=0..1000))
move_2 = Move(Geometry=deplane_4.Origin, Motion=amp_2)  # -> Geometry, Transform
ln_2 = Line(StartPoint=deplane_4.Origin, EndPoint=move_2.Geometry)
crv_17 = Curve(crv_12)
midpt_2 = CurveMiddle(Curve=ln_2)
scale_2 = Scale(Geometry=ln_2, Center=midpt_2, Factor=Slider(7.8, range=0..10))  # -> Geometry, Transform
merge_2 = Merge(Data1=scale_2.Geometry, Data2=crv_17)
mcx_2 = MultipleCurves(Curves=flatten(merge_2))  # -> Points, IndexA, IndexB, ParamA, ParamB

# ----
# 导入槽埋模型
brep_3 = Brep(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)

# ---- group: 槽埋
# 槽埋Modeling
brep_4 = Brep(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)
bbox = BoundingBox(Content=brep_3, Plane=PlaneXY(0, 0, 0))  # -> Box, Box_2
debox = DeconstructBox(Box=bbox.Box)  # -> Plane, X, Y, Z
area_2 = Area(Geometry=brep_3)  # -> Area, Centroid
pdecon = Deconstruct(Point=area_2.Centroid)  # -> XComponent, YComponent, ZComponent
dedomain = DeconstructDomain(Domain=debox.Z)  # -> Start, End
xy_11 = XYPlane(Origin=Point(0, 0, 0))
pt_3 = ConstructPoint(XCoordinate=pdecon.XComponent, YCoordinate=pdecon.YComponent, ZCoordinate=dedomain.End)
pl_origin = PlaneOrigin(Base=xy_11, Origin=pt_3)
xy_12 = XYPlane(Origin=Point(0, 0, 0))
orient = Orient(Geometry=brep_3, Source=pl_origin, Target=xy_12)  # -> Geometry, Transform

# ----
# blocks + special curves
cull_i = CullIndex(List=flatten(pln_6), Indices=mcx.IndexA, Wrap=True)
cull_i_2 = CullIndex(List=flatten(data_4), Indices=mcx.IndexA, Wrap=True)
pln_8 = Plane(cull_i)
data_8 = Data(cull_i_2)

# ----
# blocks + smooth curves
item_3 = ListItem(List=pln_6, Index=mcx.IndexA, Wrap=True)
item_4 = ListItem(List=flatten(data_4), Index=mcx.IndexA, Wrap=True)
data_9 = Data(item_4)
pln_9 = Plane(item_3)

edges = BrepEdges(Brep=bbox.Box)  # -> Naked, Interior, NonManifold
item_5 = ListItem(List=edges.Interior, Index="5", Wrap=True)
item_6 = ListItem(List=edges.Interior, Index="4", Wrap=True)
clx = CurveLine(Curve=item_6, Line=item_5)  # -> Points, Params, Count
Y = UnitY(Factor=item_5)
rotate = Rotate(Geometry=brep_3, Angle=1.570796327, Plane=clx.Points)  # -> Geometry, Transform
move_3 = Move(Geometry=rotate.Geometry, Motion=Y)  # -> Geometry, Transform
merge_3 = Merge(Data1=brep_3, Data2=move_3.Geometry)  # -> flatten(Result)
sunion_2 = SolidUnion(Breps=merge_3)
bbox_2 = BoundingBox(Content=sunion_2, Plane=PlaneXY(0, 0, 0))  # -> Box, Box_2
area_3 = Area(Geometry=sunion_2)  # -> Area, Centroid
debox_2 = DeconstructBox(Box=bbox_2.Box)  # -> Plane, X, Y, Z
pdecon_2 = Deconstruct(Point=area_3.Centroid)  # -> XComponent, YComponent, ZComponent
dedomain_2 = DeconstructDomain(Domain=debox_2.Z)  # -> Start, End
pt_4 = ConstructPoint(XCoordinate=pdecon_2.XComponent, YCoordinate=pdecon_2.YComponent, ZCoordinate=dedomain_2.End)
xy_13 = XYPlane(Origin=Point(0, 0, 0))
pl_origin_2 = PlaneOrigin(Base=xy_13, Origin=pt_4)
xy_14 = XYPlane(Origin=Point(0, 0, 0))
orient_2 = Orient(Geometry=sunion_2, Source=pl_origin_2, Target=xy_14)  # -> Geometry, Transform

# ----
# blocks + special curves
cull_i_3 = CullIndex(List=flatten(pln_7), Indices=mcx_2.IndexA, Wrap=True)
cull_i_4 = CullIndex(List=flatten(data_6), Indices=mcx_2.IndexA, Wrap=True)
pln_10 = Plane(cull_i_3)
data_10 = Data(cull_i_4)

# ----
# blocks + smooth curves
item_7 = ListItem(List=pln_7, Index=mcx_2.IndexA, Wrap=True)
item_8 = ListItem(List=flatten(data_6), Index=mcx_2.IndexA, Wrap=True)
data_11 = Data(item_8)
pln_11 = Plane(item_7)

# ----
# 导入槽埋模型
brep_5 = Brep(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)

# ----
# 第一层
# 
# Special Curves(architecture line)
crv_18 = Curve(crv_11)
pln_12 = Plane(pln_10)
deplane_5 = DeconstructPlane(Plane=pln_12)  # -> Origin, XAxis, YAxis, ZAxis
disc = Discontinuity(Curve=crv_18, Level=1)  # -> Points, Parameters
pull = PullPoint(Point=deplane_5.Origin, Geometry=disc.Points, ClosestOnly=True)  # -> ClosestPoint, Distance
sort = SortList(Keys=pull.Distance)  # -> reverse(Keys), ValuesA
panel_18 = Panel(sort.Keys)
larger = LargerThan(FirstNumber=pull.Distance, SecondNumber=Slider(300, range=0..1000))  # -> LargerThan, OrEqualTo
dispatch_5 = Dispatch(List=pln_12, DispatchPattern=larger.LargerThan)  # -> ListA, ListB
data_12 = Data(dispatch_5.ListB)
deplane_6 = DeconstructPlane(Plane=data_12)  # -> Origin, XAxis, YAxis, ZAxis
pull_2 = PullPoint(Point=deplane_6.Origin, Geometry=disc.Points, ClosestOnly=True)  # -> ClosestPoint, Distance

# ----
# 线段延长长度
number_slider = Slider(1001, range=0..10000)

# ----
# remove duplicate curves
geo_2 = Geometry(project_3.Geometry)
boundary_2 = BoundarySurfaces(Edges=geo_2)
area_4 = Area(Geometry=boundary_2)  # -> Area, Centroid
cullduppoints_3 = RemoveDuplicatePoints(InputPoints=area_4.Centroid, Tolerance=Slider(0.1, range=0..0.1))  # -> OutputPoints, FirstPointIndexes
null_3 = NullItem(Item=cullduppoints_3.FirstPointIndexes)  # -> NullFlags, InvalidFlags, Description
dispatch_6 = Dispatch(List=boundary_2, DispatchPattern=null_3.NullFlags)  # -> ListA, ListB
geo_3 = Geometry(dispatch_6.ListA)

# ----
# remove duplicate curves
geo_4 = Geometry(project.Geometry)
boundary_3 = BoundarySurfaces(Edges=geo_4)
area_5 = Area(Geometry=boundary_3)  # -> Area, Centroid
cullduppoints_4 = RemoveDuplicatePoints(InputPoints=area_5.Centroid, Tolerance=Slider(0.1, range=0..0.1))  # -> OutputPoints, FirstPointIndexes
null_4 = NullItem(Item=cullduppoints_4.FirstPointIndexes)  # -> NullFlags, InvalidFlags, Description
dispatch_7 = Dispatch(List=boundary_3, DispatchPattern=null_4.NullFlags)  # -> ListA, ListB
geo_5 = Geometry(dispatch_7.ListA)

# ----
# 调换阴阳角设定
toggle = BooleanToggle(False)

filter_7 = StreamFilter(Gate=list_8, Stream0=orient_2.Geometry, Stream1=orient.Geometry)
entwine_2 = Entwine(Branch00=orient.Geometry, Branch01=filter_7, FlattenInputs=True)
crv_19 = Curve(crv_12)
crv_20 = Curve(crv_12)
crv_21 = Curve(crv_12)
crv_22 = Curve(offset)

# ----
# Special Curve(with location)- All
pl = ConstructPlane(Origin=pull_2.ClosestPoint, XAxis=deplane_6.XAxis, YAxis=deplane_6.YAxis)

crv_23 = Curve([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])
crv_24 = Curve(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)
merge_4 = Merge(Data1=crv_23, Data2=crv_24)

# ---- group: 阴阳角区分
cp = ClosestPoint(Point=pt_2, Cloud=item_2)  # -> ClosestPoint, CPIndex, Distance
item_9 = ListItem(List=item_2, Index=cp.CPIndex, Wrap=True)
crv_cp = CurveClosestPoint(Point=item_9, Curve=offset)  # -> Point, Parameter, Distance
eval = EvaluateCurve(Curve=offset, Parameter=crv_cp.Parameter)  # -> Point, Tangent, Angle

# ----
# 板槽埋Modeling
multiplication = Multiplication(A=s_x, B=addition)
multiplication_2 = Multiplication(A=s_y, B=addition_2)
recgrid = Rectangular(Plane=PlaneXY(0, 0, 0), SizeX=s_x, SizeY=s_y, ExtentX=addition, ExtentY=addition_2)  # -> Cells, Points
直径 = Text(filter_4)
division_2 = Division(A=multiplication, B=2)
division_3 = Division(A=multiplication_2, B=2)
vec = VectorXYZ(XComponent=expr("-x", division_2), YComponent=expr("-x", division_3), ZComponent=0)  # -> Vector, Length
move_4 = Move(Geometry=recgrid.Points, Motion=vec.Vector)  # -> Geometry, Transform
division_4 = Division(A=直径, B=2)
cyl = Cylinder(Base=move_4.Geometry, Radius=division_4, Length=expr("-x", expression))
X = UnitX(Factor=直径)
multiplication_3 = Multiplication(A=直径, B=6)
edges_2 = BrepEdges(Brep=cyl)  # -> Naked, Interior, NonManifold
item_10 = ListItem(List=edges_2.Naked, Index=0, Wrap=True)
max_2 = Maximum(A=multiplication_3, B=70)
move_5 = Move(Geometry=item_10, Motion=X)  # -> Geometry, Transform
multiplication_4 = Multiplication(A=max_2, B=2)
addition_3 = Addition(A=multiplication, B=multiplication_4)
addition_4 = Addition(A=multiplication_2, B=multiplication_4)
division_5 = Division(A=t, B=2)
expression_2 = Expression(x=addition_4, Expression="Ceiling(x/10)*10/2")
expression_3 = Expression(x=addition_3, Expression="Ceiling(x/10)*10/2")
round = Round(Number=division_5)  # -> Nearest, Floor, Ceiling
multiplication_5 = Multiplication(A=round.Ceiling, B=2)
dom = ConstructDomain(DomainStart=expr("-x", expression_2), DomainEnd=expression_2)
dom_2 = ConstructDomain(DomainStart=expr("-x", expression_3), DomainEnd=expression_3)
box = DomainBox(Base=PlaneXY(0, 0, 0), X=dom_2, Y=dom, Z=multiplication_5)
Z = UnitZ(Factor=expr("-x", multiplication_5))

multiplication_6 = Multiplication(A=直径, B=5)

Z_2 = UnitZ(Factor=multiplication_6)
extr = Extrude(Base=move_5.Geometry, Direction=Z_2)
cap = CapHoles(Brep=[extr, cyl])
merge_5 = Merge(Data1=cap, Data2=box)
flatten = FlattenTree(Tree=merge_5, Path="{0}")
move_6 = Move(Geometry=flatten, Motion=Z)  # -> Geometry, Transform

brep_6 = Brep(move_6.Geometry)

# ----
# 槽埋+板埋合并
bbox_3 = BoundingBox(Content=brep_5, Plane=PlaneXY(0, 0, 0))  # -> Box, Box_2
debox_3 = DeconstructBox(Box=bbox_3.Box)  # -> Plane, X, Y, Z
area_6 = Area(Geometry=brep_5)  # -> Area, Centroid
dedomain_3 = DeconstructDomain(Domain=debox_3.Z)  # -> Start, End
pdecon_3 = Deconstruct(Point=area_6.Centroid)  # -> XComponent, YComponent, ZComponent
xy_15 = XYPlane(Origin=Point(0, 0, 0))
pt_5 = ConstructPoint(XCoordinate=pdecon_3.XComponent, YCoordinate=pdecon_3.YComponent, ZCoordinate=dedomain_3.End)
pl_origin_3 = PlaneOrigin(Base=xy_15, Origin=pt_5)
xy_16 = XYPlane(Origin=Point(0, 0, 0))
orient_3 = Orient(Geometry=brep_5, Source=pl_origin_3, Target=xy_16)  # -> Geometry, Transform
bbox_4 = BoundingBox(Content=orient_3.Geometry, Plane=PlaneXY(0, 0, 0))  # -> Box, Box_2
sdiff = SolidDifference(BrepsA=move_6.Geometry, BrepsB=bbox_4.Box)
sunion_3 = SolidUnion(Breps=[sdiff, orient_3.Geometry])  # -> flatten(Result)

edges_3 = BrepEdges(Brep=bbox_3.Box)  # -> Naked, Interior, NonManifold
item_11 = ListItem(List=edges_3.Interior, Index="5", Wrap=True)
item_12 = ListItem(List=edges_3.Interior, Index="4", Wrap=True)
clx_2 = CurveLine(Curve=item_12, Line=item_11)  # -> Points, Params, Count
Y_2 = UnitY(Factor=item_11)
rotate_2 = Rotate(Geometry=brep_5, Angle=1.570796327, Plane=clx_2.Points)  # -> Geometry, Transform
move_7 = Move(Geometry=rotate_2.Geometry, Motion=Y_2)  # -> Geometry, Transform
merge_6 = Merge(Data1=brep_5, Data2=move_7.Geometry)  # -> flatten(Result)
sunion_4 = SolidUnion(Breps=merge_6)
bbox_5 = BoundingBox(Content=sunion_4, Plane=PlaneXY(0, 0, 0))  # -> Box, Box_2
area_7 = Area(Geometry=sunion_4)  # -> Area, Centroid
debox_4 = DeconstructBox(Box=bbox_5.Box)  # -> Plane, X, Y, Z
pdecon_4 = Deconstruct(Point=area_7.Centroid)  # -> XComponent, YComponent, ZComponent
dedomain_4 = DeconstructDomain(Domain=debox_4.Z)  # -> Start, End
pt_6 = ConstructPoint(XCoordinate=pdecon_4.XComponent, YCoordinate=pdecon_4.YComponent, ZCoordinate=dedomain_4.End)
xy_17 = XYPlane(Origin=Point(0, 0, 0))
pl_origin_4 = PlaneOrigin(Base=xy_17, Origin=pt_6)
xy_18 = XYPlane(Origin=Point(0, 0, 0))
orient_4 = Orient(Geometry=sunion_4, Source=pl_origin_4, Target=xy_18)  # -> Geometry, Transform

entwine_3 = Entwine(Branch00=sunion_3, Branch01=orient_4.Geometry, FlattenInputs=True)

# ----
# 板埋Modeling
multiplication_7 = Multiplication(A=s_x, B=addition)
multiplication_8 = Multiplication(A=s_y, B=addition_2)
recgrid_2 = Rectangular(Plane=PlaneXY(0, 0, 0), SizeX=s_x, SizeY=s_y, ExtentX=addition, ExtentY=addition_2)  # -> Cells, Points
直径_2 = Text(filter_4)
division_6 = Division(A=multiplication_7, B=2)
division_7 = Division(A=multiplication_8, B=2)
vec_2 = VectorXYZ(XComponent=expr("-x", division_6), YComponent=expr("-x", division_7), ZComponent=0)  # -> Vector, Length
move_8 = Move(Geometry=recgrid_2.Points, Motion=vec_2.Vector)  # -> Geometry, Transform
division_8 = Division(A=直径_2, B=2)
cyl_2 = Cylinder(Base=move_8.Geometry, Radius=division_8, Length=expr("-x", expression))
X_2 = UnitX(Factor=直径_2)
multiplication_9 = Multiplication(A=直径_2, B=6)
edges_4 = BrepEdges(Brep=cyl_2)  # -> Naked, Interior, NonManifold
item_13 = ListItem(List=edges_4.Naked, Index=0, Wrap=True)
max_3 = Maximum(A=multiplication_9, B=70)
move_9 = Move(Geometry=item_13, Motion=X_2)  # -> Geometry, Transform
multiplication_10 = Multiplication(A=max_3, B=2)
addition_5 = Addition(A=multiplication_7, B=multiplication_10)
addition_6 = Addition(A=multiplication_8, B=multiplication_10)
division_9 = Division(A=t, B=2)
expression_4 = Expression(x=addition_6, Expression="Ceiling(x/10)*10/2")
expression_5 = Expression(x=addition_5, Expression="Ceiling(x/10)*10/2")
round_2 = Round(Number=division_9)  # -> Nearest, Floor, Ceiling
multiplication_11 = Multiplication(A=round_2.Ceiling, B=2)
dom_3 = ConstructDomain(DomainStart=expr("-x", expression_4), DomainEnd=expression_4)
dom_4 = ConstructDomain(DomainStart=expr("-x", expression_5), DomainEnd=expression_5)
box_2 = DomainBox(Base=PlaneXY(0, 0, 0), X=dom_4, Y=dom_3, Z=multiplication_11)
Z_3 = UnitZ(Factor=expr("-x", multiplication_11))
move_10 = Move(Geometry=box_2, Motion=Z_3)  # -> Geometry, Transform
Z_4 = UnitZ(Factor=expr("-x", multiplication_11))

multiplication_12 = Multiplication(A=直径_2, B=5)

Z_5 = UnitZ(Factor=multiplication_12)
extr_2 = Extrude(Base=move_9.Geometry, Direction=Z_5)
cap_2 = CapHoles(Brep=[extr_2, cyl_2])
merge_7 = Merge(Data1=cap_2, Data2=box_2)
flatten_2 = FlattenTree(Tree=merge_7, Path="{0}")
move_11 = Move(Geometry=flatten_2, Motion=Z_4)  # -> Geometry, Transform

box_3 = DomainBox(Base=PlaneXY(0, 0, 0), X=dom_4, Y=dom_4, Z=multiplication_11)
merge_8 = Merge(Data1=cap_2, Data2=box_3)
flatten_3 = FlattenTree(Tree=merge_8, Path="{0}")
move_12 = Move(Geometry=flatten_3, Motion=Z_4)  # -> Geometry, Transform
entwine_4 = Entwine(Branch00=move_11.Geometry, Branch01=move_12.Geometry, FlattenInputs=True)

# ---- group: 选单体
板埋or槽埋or板槽埋 = StreamFilter(Gate=list, Stream0=entwine_4, Stream1=entwine_2, Stream2=entwine_3)

# ----
# 三视图
# hidden lines of top+pers view
# move to center
# 如果无法完整的生成埋件的三视图，
# 建议选择埋件的3D在Rhino中将
# Top/Perspective/Front/Right 试图缩放至合适大小后重新运行
panel_19 = Panel("""Top
Perspective
Front
Right""")
m2d_rhino = Make2DRhinoView(Name=panel_19, Clip=True)
make2d = Make2D(Geometry=板埋or槽埋or板槽埋, View=m2d_rhino, TangentEdges=False, TangentSeams=False, AutoComputeMake2D=False)  # -> VisibleCurves, VisibleIndex, VisibleType, HiddenCurves, HiddenIndex, HiddenType
bang = ExplodeTree(Data=make2d.VisibleCurves)  # -> Branch0, Branch1, Branch2, Branch3, Branch4, Branch5, Branch6, Branch7
bang_2 = ExplodeTree(Data=make2d.VisibleCurves)  # -> Branch0, Branch1, Branch2, Branch3, Branch4, Branch5, Branch6, Branch7
divdist = DivideDistance(Curve=make2d.HiddenCurves, Distance=Slider(1, range=0..10))  # -> Points, Tangents, Parameters
graft = GraftTree(Tree=make2d.HiddenCurves, IncludeEmptyLists=True, IncludeNullItems=True)
shatter = Shatter(Curve=graft, Parameters=divdist.Parameters)
dispatch_8 = Dispatch(List=shatter, DispatchPattern=[True, False])  # -> ListA, ListB
crv_25 = Curve(dispatch_8.ListA)
pshift = ShiftPaths(Data=crv_25, Offset=-1)
pshift_2 = ShiftPaths(Data=pshift, Offset=-1)
bang_3 = ExplodeTree(Data=pshift_2)  # -> Branch0, Branch1, Branch2, Branch3, Branch4, Branch5, Branch6, Branch7
bang_4 = ExplodeTree(Data=pshift_2)  # -> Branch0, Branch1, Branch2, Branch3, Branch4, Branch5, Branch6, Branch7
entwine_5 = Entwine(Branch00=bang_4.Branch4, Branch01=bang_2.Branch4, FlattenInputs=True)  # -> flatten(Result)
entwine_6 = Entwine(Branch00=bang_4.Branch5, Branch01=bang_2.Branch5, FlattenInputs=True)  # -> flatten(Result)
entwine_7 = Entwine(Branch00=bang_3.Branch0, Branch01=bang.Branch0, FlattenInputs=True)  # -> flatten(Result)
entwine_8 = Entwine(Branch00=bang_3.Branch1, Branch01=bang.Branch1, FlattenInputs=True)  # -> flatten(Result)
entwine_9 = Entwine(Branch00=entwine_7, Branch01=entwine_8, Branch02=bang.Branch2, Branch03=bang.Branch3, FlattenInputs=True)
entwine_10 = Entwine(Branch00=entwine_5, Branch01=entwine_6, Branch02=bang_2.Branch6, Branch03=bang_2.Branch7, FlattenInputs=True)
group = Group(Objects=entwine_9)
group_2 = Group(Objects=entwine_10)
entwine_11 = Entwine(Branch00=group, Branch01=group_2, FlattenInputs=True)
pshift_3 = ShiftPaths(Data=entwine_11, Offset=-1)
pshift_4 = ShiftPaths(Data=entwine_11, Offset=-1)
number_slider_2 = Slider(2, range=0..10)
# Rhino 文件中导入的块名
boxprop = BoxProperties(Box=pshift_3)  # -> Center, Diagonal, Area, Volume, Degeneracy
pt_7 = Point(Point(957.9296072, 367.7685097, 0))
pt_8 = Point("0,0,0")
recgrid_3 = Rectangular(
    Plane=pt_7,
    SizeX=Slider(12, range=1..20, expression="X*50"),
    SizeY=Slider(10, range=1..20, expression="X*50"),
    ExtentX=number_slider_2,
    ExtentY=number_slider_2)  # -> Cells, Points
vec2pt = Vector2Pt(PointA=boxprop.Center, PointB=pt_8, Unitize=False)  # -> Vector, Length
flatten_4 = FlattenTree(Tree=recgrid_3.Points, Path="{0}")
move_13 = Move(Geometry=pshift_4, Motion=vec2pt.Vector)  # -> flatten(Geometry), Transform
orient_5 = Orient(Geometry=flatten(move_13.Geometry), Source=PlaneXY(0, 0, 0), Target=flatten_4)  # -> Geometry, Transform
cull_i_5 = CullIndex(List=orient_5.Geometry, Indices="-1", Wrap=True)
split = SplitList(List=cull_i_5, Index="4")  # -> ListA, ListB
data_13 = Data(split.ListA)
data_14 = Data(split.ListB)
entwine_12 = Entwine(Branch00=data_13, Branch01=data_14, FlattenInputs=True)
geo_6 = Geometry(entwine_12)

# ---- group: 单体定Top/Side
item_14 = ListItem(List=geo_6, Index=2, Wrap=True)
item_15 = ListItem(List=geo_6, Index=Slider(0, range=0..10), Wrap=True)
cluster = Cluster(G=item_15)
cluster_2 = Cluster(G=item_14)

# ---- group: 单体定Top/Side / Top/Side
filter_8 = StreamFilter(Gate=list_2, Stream0=cluster, Stream1=cluster_2)

# ---- group: 单体定Top/Side / Monomer + Top/Side
filter_9 = StreamFilter(Gate=list, Stream0=filter_8, Stream1=filter_8, Stream2=filter_8)  # -> flatten(Stream)

# ---- group: Block
# 自定义块所在图层
# 自定义块所在图层颜色
# 自定义块名称
panel_20 = Panel("Embeded::Embeded")
layer_3 = DefineLayer(Name=panel_20, Color=ColourSwatch(SwatchColor=RGB(255, 0, 0)))
attributes = DefineObjectAttributes(Layer=layer_3)
block = DefineBlock(Geometry=filter_8, Attributes=attributes, BlockName="Steel Plate", BasePlane=PlaneXY(0, 0, 0))

# ---- group: 正常+阳角+阴角区分
cull_i_6 = CullIndex(List=item_2, Indices=cp.CPIndex, Wrap=True)
crv_26 = Curve(offset)
crv_27 = Curve(flip.Curve)
explode_2 = Explode(Curve=crv_26, Recursive=True)  # -> Segments, Vertices
explode_3 = Explode(Curve=crv_27, Recursive=True)  # -> Segments, Vertices

# ---- group: 阴角定位-细化
item_16 = ListItem(List=item, Index=cp.CPIndex, Wrap=True)

# ----
# 求主体曲线转折点
clscrv = CloseCurve(Curve=crv_14, CloseType=0, Bulge=0.5, Tolerance=0)  # -> Closed, R
crv_28 = Curve(crv_12)
disc_2 = Discontinuity(Curve=graft(crv_28), Level=1)  # -> Points, Parameters
crv_cp_2 = CurveClosestPoint(Point=disc_2.Points, Curve=graft(crv_28))  # -> Point, Parameter, Distance
eval_2 = EvaluateCurve(Curve=graft(crv_28), Parameter=crv_cp_2.Parameter)  # -> flatten(Point), Tangent, flatten(Angle)
deg = Degrees(Radians=eval_2.Angle)
offset_2 = OffsetCurve(Curve=clscrv.Closed, Distance=expr("-X", Slider(300, range=0..1000)), Corners=1)
panel_21 = Panel(deg)
larger_2 = LargerThan(FirstNumber=deg, SecondNumber=Slider(60, range=0..100))  # -> LargerThan, OrEqualTo
disc_3 = Discontinuity(Curve=offset_2, Level=1)  # -> flatten(Points), Parameters
dispatch_9 = Dispatch(List=eval_2.Point, DispatchPattern=larger_2.LargerThan)  # -> ListA, ListB

# ----
# 第一层
# 
# Angular Curves(architecture line)
crv_29 = Curve(crv_13)
crv_30 = Curve(clscrv.Closed)
offset_3 = OffsetCurve(Curve=crv_30, Distance=expr("-x", Slider(84, range=0..1000)), Corners=1)  # -> flatten(Curve)
disc_4 = Discontinuity(Curve=crv_29, Level=1)  # -> Points, Parameters
pull_3 = PullPoint(Point=disc_4.Points, Geometry=offset_3, ClosestOnly=True)  # -> ClosestPoint, Distance
disc_5 = Discontinuity(Curve=offset_3, Level=1)  # -> Points, Parameters
pull_4 = PullPoint(Point=flatten(pull_3.ClosestPoint), Geometry=flatten(disc_5.Points), ClosestOnly=True)  # -> ClosestPoint, Distance
check_same_points = CheckSamePoints(archPoint=flatten(pull_3.ClosestPoint), crvPoint=flatten(pull_4.ClosestPoint))  # -> out, specialPt; inputs archPoint: list of Point3d, crvPoint: list of Point3d
# ---------- check_same_points: C# ----------
    List<int> passIndex = new List<int>();

    for(int i = 0; i < archPoint.Count; i++){
      foreach(Point3d t in crvPoint){
        if(archPoint[i].X == t.X && archPoint[i].Y == t.Y && archPoint[i].Z == t.Z){
          Print("pass");
          passIndex.Add(i);}
      }
    }

    specialPt = passIndex;
# ---------- end check_same_points ----------
cull_i_7 = CullIndex(List=flatten(disc_4.Points), Indices=check_same_points.specialPt, Wrap=True)
end = EndPoints(Curve=crv_29)  # -> Start, End
merge_9 = Merge(Data1=end.Start, Data2=end.End, Data3=cull_i_7)
flatten_5 = FlattenTree(Tree=disc_4.Points, Path="{0}")
check_same_points_2 = CheckSamePoints(archPoint=flatten(flatten_5), crvPoint=flatten(merge_9))  # -> out, specialPt; inputs archPoint: list of Point3d, crvPoint: list of Point3d; same code as check_same_points
cull_i_8 = CullIndex(List=flatten(flatten_5), Indices=check_same_points_2.specialPt, Wrap=True)
pull_5 = PullPoint(Point=cull_i_8, Geometry=offset_3, ClosestOnly=True)  # -> ClosestPoint, Distance
ln_3 = Line(StartPoint=cull_i_8, EndPoint=pull_5.ClosestPoint)
rotate_3 = Rotate(Geometry=ln_3, Angle="Pi", Plane=cull_i_8)  # -> Geometry, Transform
rotate_4 = Rotate(Geometry=rotate_3.Geometry, Angle=-1.570796327, Plane=cull_i_8)  # -> Geometry, Transform

# ----
# 第一层
# 
# Angular Curves(architecture line)
number_slider_3 = Slider(84, range=0..1000)
crv_31 = Curve(project_9.Geometry)
crv_32 = Curve(clscrv.Closed)
offset_4 = OffsetCurve(Curve=crv_32, Distance=expr("-x", number_slider_3), Corners=1)  # -> flatten(Curve)
disc_6 = Discontinuity(Curve=crv_31, Level=1)  # -> Points, Parameters
pull_6 = PullPoint(Point=disc_6.Points, Geometry=offset_4, ClosestOnly=True)  # -> ClosestPoint, Distance
disc_7 = Discontinuity(Curve=offset_4, Level=1)  # -> Points, Parameters
pull_7 = PullPoint(Point=flatten(pull_6.ClosestPoint), Geometry=flatten(disc_7.Points), ClosestOnly=True)  # -> ClosestPoint, Distance
check_same_points_3 = CheckSamePoints(archPoint=flatten(pull_6.ClosestPoint), crvPoint=flatten(pull_7.ClosestPoint))  # -> out, specialPt; inputs archPoint: list of Point3d, crvPoint: list of Point3d; same code as check_same_points
cull_i_9 = CullIndex(List=flatten(disc_6.Points), Indices=check_same_points_3.specialPt, Wrap=True)
end_2 = EndPoints(Curve=crv_31)  # -> Start, End
merge_10 = Merge(Data1=end_2.Start, Data2=end_2.End, Data3=cull_i_9)
flatten_6 = FlattenTree(Tree=disc_6.Points, Path="{0}")
check_same_points_4 = CheckSamePoints(archPoint=flatten(flatten_6), crvPoint=flatten(merge_10))  # -> out, specialPt; inputs archPoint: list of Point3d, crvPoint: list of Point3d; same code as check_same_points
cull_i_10 = CullIndex(List=flatten(flatten_6), Indices=check_same_points_4.specialPt, Wrap=True)
pull_8 = PullPoint(Point=cull_i_10, Geometry=offset_4, ClosestOnly=True)  # -> ClosestPoint, Distance
ln_4 = Line(StartPoint=cull_i_10, EndPoint=pull_8.ClosestPoint)
rotate_5 = Rotate(Geometry=ln_4, Angle="Pi", Plane=cull_i_10)  # -> Geometry, Transform
rotate_6 = Rotate(Geometry=ln_4, Angle=1.570796327, Plane=cull_i_10)  # -> Geometry, Transform

# ----
# 转角点
data_15 = Data(dispatch_9.ListA)

pull_9 = PullPoint(Point=data_15, Geometry=flatten(offset_2), ClosestOnly=True)  # -> ClosestPoint, Distance
testpoint = TestPoint(archPoint=pull_9.ClosestPoint, crvPoint=disc_3.Points)  # -> out, specialPt; inputs archPoint: list of Point3d, crvPoint: list of Point3d; same code as check_same_points

# ----
# 找阴阳角所在corners
pull_10 = PullPoint(Point=flatten(pln_11), Geometry=crv_28, ClosestOnly=True)  # -> ClosestPoint, Distance
pull_11 = PullPoint(Point=pull_10.ClosestPoint, Geometry=data_15, ClosestOnly=True)  # -> ClosestPoint, Distance
flatten_7 = FlattenTree(Tree=data_11, Path="{0}")
sort_2 = SortList(Keys=pull_11.Distance, ValuesA=flatten_7)  # -> Keys, ValuesA
panel_22 = Panel(sort_2.Keys)
smaller = SmallerThan(FirstNumber=sort_2.Keys, SecondNumber=Slider(100, range=0..100))  # -> SmallerThan, OrEqualTo
dispatch_10 = Dispatch(List=sort_2.ValuesA, DispatchPattern=smaller.SmallerThan)  # -> ListA, ListB
data_16 = Data(dispatch_10.ListA)
deblock_6 = DeconstructBlock(Block=data_16)  # -> Name, Plane, Geometry
deplane_7 = DeconstructPlane(Plane=deblock_6.Plane)  # -> Origin, XAxis, YAxis, ZAxis
pt_9 = Point(data_15)
pull_12 = PullPoint(Point=deplane_7.Origin, Geometry=pt_9, ClosestOnly=True)  # -> ClosestPoint, Distance
cir = Circle(Plane=pull_12.ClosestPoint, Radius=Slider(300, range=0..1000))
crv_33 = Curve(crv_28)
amp_3 = Amplitude(Vector=deplane_7.YAxis, Amplitude=Slider(200, range=0..1000))
ccx = CurveCurve(CurveA=cir, CurveB=crv_33)  # -> Points, ParamsA, ParamsB
move_14 = Move(Geometry=pull_12.ClosestPoint, Motion=amp_3)  # -> Geometry, Transform
item_17 = ListItem(List=ccx.Points, Index=0, Wrap=True)
clean = CleanTree(RemoveNulls=True, RemoveInvalid=True, RemoveEmpty=Toggle(True), Tree=item_17)
ln_5 = Line(StartPoint=pull_12.ClosestPoint, EndPoint=clean)
ln_6 = Line(StartPoint=pull_12.ClosestPoint, EndPoint=move_14.Geometry)
angle = Angle(VectorA=ln_6, VectorB=ln_5)  # -> Angle, Reflex
deg_2 = Degrees(Radians=angle.Angle)
flatten_8 = FlattenTree(Tree=deg_2, Path="{0}")
panel_23 = Panel(flatten_8)
c_script = CSharpScript(angle=flatten_8, minus=Slider(80, range=0..100))  # -> out, results; inputs angle: list of Double, minus: Double
# ---------- c_script: C# ----------
    List<double> MyAngle = new List<double>();
    for(int i = 0; i < angle.Count; i++){
      if (angle[i] > minus){
        angleEach = angle[i] - 90;
        Print("!!!!!!!!");
        MyAngle.Add(angleEach);
      }
      else{
        angleEach = angle[i];
        Print("00000");
        MyAngle.Add(angleEach);
      }

    }

    results = MyAngle;
# ---------- c_script: C# additional code ----------
  double angleEach = 0;
# ---------- end c_script ----------
larger_3 = LargerThan(FirstNumber=c_script.results, SecondNumber=Slider(30, range=0..100))  # -> LargerThan, OrEqualTo
panel_24 = Panel(c_script.results)
dispatch_11 = Dispatch(List=flatten(data_16), DispatchPattern=flatten(larger_3.LargerThan))  # -> ListA, ListB
data_17 = Data(dispatch_11.ListA)

# ----
# SmoothCurve-阴角&阳角
# 阳角
item_18 = ListItem(List=data_15, Index=testpoint.specialPt, Wrap=True)

# ----
# 阴角
cull_i_11 = CullIndex(List=data_15, Indices=testpoint.specialPt, Wrap=True)

# ----
# remove duplicate block and reconstruct plane
deblock_7 = DeconstructBlock(Block=data_17)  # -> Name, Plane, Geometry
deplane_8 = DeconstructPlane(Plane=flatten(deblock_7.Plane))  # -> Origin, XAxis, YAxis, ZAxis

# ----
# 第一层
# 
# Block(location point) + Smooth Curves(architecture line)
pln_13 = Plane(flatten(pln_11))
deplane_9 = DeconstructPlane(Plane=pln_13)  # -> Origin, XAxis, YAxis, ZAxis
testpoint_2 = TestPoint(archPoint=deplane_9.Origin, crvPoint=deplane_8.Origin)  # -> out, specialPt; inputs archPoint: list of Point3d, crvPoint: list of Point3d; same code as check_same_points
cull_i_12 = CullIndex(List=pln_13, Indices=testpoint_2.specialPt, Wrap=True)
pln_14 = Plane(deblock_7.Plane)
dist = Distance(PointA=graft(deplane_8.Origin), PointB=item_18)
sort_3 = SortList(Keys=dist)  # -> Keys, ValuesA
item_19 = ListItem(List=sort_3.Keys, Index=0, Wrap=True)
flatten_9 = FlattenTree(Tree=item_19, Path="{0}")
smaller_2 = SmallerThan(FirstNumber=item_19, SecondNumber=Slider(100, range=0..300))  # -> SmallerThan, OrEqualTo
panel_25 = Panel(flatten_9)
dispatch_12 = Dispatch(List=graft(pln_14), DispatchPattern=smaller_2.SmallerThan)  # -> ListA, ListB

pln_15 = Plane(cull_i_12)

data_18 = Data(flatten(dispatch_12.ListA))
deplane_10 = DeconstructPlane(Plane=data_18)  # -> Origin, XAxis, YAxis, ZAxis
amp_4 = Amplitude(Vector=deplane_10.YAxis, Amplitude=Slider(300, range=0..1000))
move_15 = Move(Geometry=deplane_10.Origin, Motion=amp_4)  # -> Geometry, Transform
ln_7 = Line(StartPoint=deplane_10.Origin, EndPoint=move_15.Geometry)
midpt_3 = CurveMiddle(Curve=ln_7)
scale_3 = Scale(Geometry=ln_7, Center=midpt_3, Factor=Slider(1.5, range=0..10))  # -> Geometry, Transform
ccx_2 = CurveCurve(CurveA=graft(scale_3.Geometry), CurveB=crv_20)  # -> flatten(Points), ParamsA, ParamsB

data_19 = Data(flatten(dispatch_12.ListB))
deplane_11 = DeconstructPlane(Plane=data_19)  # -> Origin, XAxis, YAxis, ZAxis
amp_5 = Amplitude(Vector=deplane_11.YAxis, Amplitude=Slider(300, range=0..1000))
move_16 = Move(Geometry=deplane_11.Origin, Motion=amp_5)  # -> Geometry, Transform
ln_8 = Line(StartPoint=deplane_11.Origin, EndPoint=move_16.Geometry)
midpt_4 = CurveMiddle(Curve=ln_8)
scale_4 = Scale(Geometry=ln_8, Center=midpt_4, Factor=Slider(1.5, range=0..10))  # -> Geometry, Transform
ccx_3 = CurveCurve(CurveA=graft(scale_4.Geometry), CurveB=crv_20)  # -> flatten(Points), ParamsA, ParamsB

data_20 = Data(flatten(pln_15))
deplane_12 = DeconstructPlane(Plane=data_20)  # -> Origin, XAxis, YAxis, ZAxis
amp_6 = Amplitude(Vector=deplane_12.YAxis, Amplitude=Slider(300, range=0..1000))
move_17 = Move(Geometry=deplane_12.Origin, Motion=amp_6)  # -> Geometry, Transform
ln_9 = Line(StartPoint=deplane_12.Origin, EndPoint=move_17.Geometry)
midpt_5 = CurveMiddle(Curve=ln_9)
scale_5 = Scale(Geometry=ln_9, Center=midpt_5, Factor=Slider(4.7, range=0..10))  # -> Geometry, Transform
ccx_4 = CurveCurve(CurveA=graft(scale_5.Geometry), CurveB=crv_20)  # -> flatten(Points), ParamsA, ParamsB

# ----
# Angular Curve - All
pl_2 = ConstructPlane(Origin=cull_i_8, XAxis=rotate_3.Geometry, YAxis=rotate_4.Geometry)

# ----
# Curve for this project only - All
pl_3 = ConstructPlane(Origin=cull_i_10, XAxis=rotate_5.Geometry, YAxis=rotate_6.Geometry)

# ----
# SmoothCurve-正常
move2pt = MoveToPoint(Geometry=data_20, PointA=deplane_12.Origin, PointB=ccx_4.Points)  # -> Moved, Vector, Transform

# ----
# SmoothCurve-阳角
move2pt_2 = MoveToPoint(Geometry=data_18, PointA=deplane_10.Origin, PointB=ccx_2.Points)  # -> Moved, Vector, Transform

# ----
# SmoothCurve-阴角
move2pt_3 = MoveToPoint(Geometry=data_19, PointA=deplane_11.Origin, PointB=ccx_3.Points)  # -> Moved, Vector, Transform

# ----
# 求主体曲线转折点
clscrv_2 = CloseCurve(Curve=crv_14, CloseType=0, Bulge=0.5, Tolerance=0)  # -> Closed, R
crv_34 = Curve(crv_12)
disc_8 = Discontinuity(Curve=graft(crv_34), Level=1)  # -> Points, Parameters
crv_cp_3 = CurveClosestPoint(Point=disc_8.Points, Curve=graft(crv_34))  # -> Point, Parameter, Distance
eval_3 = EvaluateCurve(Curve=graft(crv_34), Parameter=crv_cp_3.Parameter)  # -> flatten(Point), Tangent, flatten(Angle)
deg_3 = Degrees(Radians=eval_3.Angle)
offset_5 = OffsetCurve(Curve=clscrv_2.Closed, Distance=expr("-X", Slider(300, range=0..1000)), Corners=1)
panel_26 = Panel(deg_3)
larger_4 = LargerThan(FirstNumber=deg_3, SecondNumber=Slider(60, range=0..100))  # -> LargerThan, OrEqualTo
disc_9 = Discontinuity(Curve=offset_5, Level=1)  # -> flatten(Points), Parameters
dispatch_13 = Dispatch(List=eval_3.Point, DispatchPattern=larger_4.LargerThan)  # -> ListA, ListB

# ----
# 转角点
data_21 = Data(dispatch_13.ListA)

pull_13 = PullPoint(Point=data_21, Geometry=flatten(offset_5), ClosestOnly=True)  # -> ClosestPoint, Distance
testpoint_3 = TestPoint(archPoint=pull_13.ClosestPoint, crvPoint=disc_9.Points)  # -> out, specialPt; inputs archPoint: list of Point3d, crvPoint: list of Point3d; same code as check_same_points

# ----
# 找阴阳角所在corners
pull_14 = PullPoint(Point=flatten(pln_9), Geometry=crv_34, ClosestOnly=True)  # -> ClosestPoint, Distance
pull_15 = PullPoint(Point=pull_14.ClosestPoint, Geometry=data_21, ClosestOnly=True)  # -> ClosestPoint, Distance
flatten_10 = FlattenTree(Tree=data_9, Path="{0}")
sort_4 = SortList(Keys=pull_15.Distance, ValuesA=flatten_10)  # -> Keys, ValuesA
panel_27 = Panel(sort_4.Keys)
smaller_3 = SmallerThan(FirstNumber=sort_4.Keys, SecondNumber=Slider(100, range=0..100))  # -> SmallerThan, OrEqualTo
dispatch_14 = Dispatch(List=sort_4.ValuesA, DispatchPattern=smaller_3.SmallerThan)  # -> ListA, ListB
data_22 = Data(dispatch_14.ListA)
deblock_8 = DeconstructBlock(Block=data_22)  # -> Name, Plane, Geometry
deplane_13 = DeconstructPlane(Plane=deblock_8.Plane)  # -> Origin, XAxis, YAxis, ZAxis
pt_10 = Point(data_21)
pull_16 = PullPoint(Point=deplane_13.Origin, Geometry=pt_10, ClosestOnly=True)  # -> ClosestPoint, Distance
cir_2 = Circle(Plane=pull_16.ClosestPoint, Radius=Slider(300, range=0..1000))
crv_35 = Curve(crv_34)
amp_7 = Amplitude(Vector=deplane_13.YAxis, Amplitude=Slider(200, range=0..1000))
ccx_5 = CurveCurve(CurveA=cir_2, CurveB=crv_35)  # -> Points, ParamsA, ParamsB
move_18 = Move(Geometry=pull_16.ClosestPoint, Motion=amp_7)  # -> Geometry, Transform
item_20 = ListItem(List=ccx_5.Points, Index=0, Wrap=True)
clean_2 = CleanTree(RemoveNulls=True, RemoveInvalid=True, RemoveEmpty=Toggle(True), Tree=item_20)
ln_10 = Line(StartPoint=pull_16.ClosestPoint, EndPoint=clean_2)
ln_11 = Line(StartPoint=pull_16.ClosestPoint, EndPoint=move_18.Geometry)
angle_2 = Angle(VectorA=ln_11, VectorB=ln_10)  # -> Angle, Reflex
deg_4 = Degrees(Radians=angle_2.Angle)
flatten_11 = FlattenTree(Tree=deg_4, Path="{0}")
panel_28 = Panel(flatten_11)
c_script_2 = CSharpScript(angle=flatten_11, minus=Slider(80, range=0..100))  # -> out, results; inputs angle: list of Double, minus: Double; same code as c_script
larger_5 = LargerThan(FirstNumber=c_script_2.results, SecondNumber=Slider(30, range=0..100))  # -> LargerThan, OrEqualTo
panel_29 = Panel(c_script_2.results)
dispatch_15 = Dispatch(List=flatten(data_22), DispatchPattern=flatten(larger_5.LargerThan))  # -> ListA, ListB
data_23 = Data(dispatch_15.ListA)

# ----
# SmoothCurve-阴角&阳角
# 阳角
item_21 = ListItem(List=data_21, Index=testpoint_3.specialPt, Wrap=True)

# ----
# 阴角
cull_i_13 = CullIndex(List=data_21, Indices=testpoint_3.specialPt, Wrap=True)

# ----
# remove duplicate block and reconstruct plane
deblock_9 = DeconstructBlock(Block=data_23)  # -> Name, Plane, Geometry
deplane_14 = DeconstructPlane(Plane=flatten(deblock_9.Plane))  # -> Origin, XAxis, YAxis, ZAxis

# ----
# 第一层
# 
# Block(location point) + Smooth Curves(architecture line)
pln_16 = Plane(flatten(pln_9))
deplane_15 = DeconstructPlane(Plane=pln_16)  # -> Origin, XAxis, YAxis, ZAxis
testpoint_4 = TestPoint(archPoint=deplane_15.Origin, crvPoint=deplane_14.Origin)  # -> out, specialPt; inputs archPoint: list of Point3d, crvPoint: list of Point3d; same code as check_same_points
cull_i_14 = CullIndex(List=pln_16, Indices=testpoint_4.specialPt, Wrap=True)
pln_17 = Plane(deblock_9.Plane)
dist_2 = Distance(PointA=graft(deplane_14.Origin), PointB=item_21)
sort_5 = SortList(Keys=dist_2)  # -> Keys, ValuesA
item_22 = ListItem(List=sort_5.Keys, Index=0, Wrap=True)
flatten_12 = FlattenTree(Tree=item_22, Path="{0}")
smaller_4 = SmallerThan(FirstNumber=item_22, SecondNumber=Slider(100, range=0..300))  # -> SmallerThan, OrEqualTo
panel_30 = Panel(flatten_12)
dispatch_16 = Dispatch(List=graft(pln_17), DispatchPattern=smaller_4.SmallerThan)  # -> ListA, ListB

pln_18 = Plane(cull_i_14)

data_24 = Data(flatten(dispatch_16.ListA))
deplane_16 = DeconstructPlane(Plane=data_24)  # -> Origin, XAxis, YAxis, ZAxis
amp_8 = Amplitude(Vector=deplane_16.YAxis, Amplitude=Slider(300, range=0..1000))
move_19 = Move(Geometry=deplane_16.Origin, Motion=amp_8)  # -> Geometry, Transform
ln_12 = Line(StartPoint=deplane_16.Origin, EndPoint=move_19.Geometry)
midpt_6 = CurveMiddle(Curve=ln_12)
scale_6 = Scale(Geometry=ln_12, Center=midpt_6, Factor=Slider(1.5, range=0..10))  # -> Geometry, Transform
ccx_6 = CurveCurve(CurveA=graft(scale_6.Geometry), CurveB=crv_21)  # -> flatten(Points), ParamsA, ParamsB

data_25 = Data(flatten(dispatch_16.ListB))
deplane_17 = DeconstructPlane(Plane=data_25)  # -> Origin, XAxis, YAxis, ZAxis
amp_9 = Amplitude(Vector=deplane_17.YAxis, Amplitude=Slider(300, range=0..1000))
move_20 = Move(Geometry=deplane_17.Origin, Motion=amp_9)  # -> Geometry, Transform
ln_13 = Line(StartPoint=deplane_17.Origin, EndPoint=move_20.Geometry)
midpt_7 = CurveMiddle(Curve=ln_13)
scale_7 = Scale(Geometry=ln_13, Center=midpt_7, Factor=Slider(1.5, range=0..10))  # -> Geometry, Transform
ccx_7 = CurveCurve(CurveA=graft(scale_7.Geometry), CurveB=crv_21)  # -> flatten(Points), ParamsA, ParamsB

data_26 = Data(flatten(pln_18))
deplane_18 = DeconstructPlane(Plane=data_26)  # -> Origin, XAxis, YAxis, ZAxis
amp_10 = Amplitude(Vector=deplane_18.YAxis, Amplitude=Slider(300, range=0..1000))
move_21 = Move(Geometry=deplane_18.Origin, Motion=amp_10)  # -> Geometry, Transform
ln_14 = Line(StartPoint=deplane_18.Origin, EndPoint=move_21.Geometry)
midpt_8 = CurveMiddle(Curve=ln_14)
scale_8 = Scale(Geometry=ln_14, Center=midpt_8, Factor=Slider(4.7, range=0..10))  # -> Geometry, Transform
ccx_8 = CurveCurve(CurveA=graft(scale_8.Geometry), CurveB=crv_21)  # -> flatten(Points), ParamsA, ParamsB

move2pt_4 = MoveToPoint(Geometry=data_26, PointA=deplane_18.Origin, PointB=ccx_8.Points)  # -> Moved, Vector, Transform
move2pt_5 = MoveToPoint(Geometry=data_24, PointA=deplane_16.Origin, PointB=ccx_6.Points)  # -> Moved, Vector, Transform
move2pt_6 = MoveToPoint(Geometry=data_25, PointA=deplane_17.Origin, PointB=ccx_7.Points)  # -> Moved, Vector, Transform
xy_19 = XYPlane(Origin=move2pt_4.Moved)
xy_20 = XYPlane(Origin=move2pt_5.Moved)
xy_21 = XYPlane(Origin=move2pt_6.Moved)
rotate_7 = Rotate(Geometry=move2pt_4.Moved, Angle="Pi", Plane=xy_19)  # -> Geometry, Transform
rotate_8 = Rotate(Geometry=move2pt_5.Moved, Angle="Pi", Plane=xy_20)  # -> Geometry, Transform
rotate_9 = Rotate(Geometry=move2pt_6.Moved, Angle="Pi", Plane=xy_21)  # -> Geometry, Transform

# ----
# SmoothCurve-正常
toggle_2 = BooleanToggle(True)
filter_10 = StreamFilter(Gate=toggle_2, Stream0=move2pt_4.Moved, Stream1=rotate_7.Geometry)

# ----
# SmoothCurve-阳角
toggle_3 = BooleanToggle(True)
filter_11 = StreamFilter(Gate=toggle_3, Stream0=move2pt_5.Moved, Stream1=rotate_8.Geometry)

# ----
# SmoothCurve-阴角
toggle_4 = BooleanToggle(True)
filter_12 = StreamFilter(Gate=toggle_4, Stream0=move2pt_6.Moved, Stream1=rotate_9.Geometry)

# ----
# 求内部曲线转折点
crv_36 = Curve(crv_10)
number_slider_4 = Slider(300, range=0..1000)
neg = Negative(Value=number_slider_4)
filter_13 = StreamFilter(Gate=toggle, Stream0=number_slider_4, Stream1=neg)

ext = ExtendCurve(Curve=crv_36, Type=0, Start=number_slider, End=number_slider)

# ----
# 第一层
# 
# Curves(location point)+ Smooth Curves(architecture line)
# 第二层-大面定位
area_8 = Area(Geometry=geo_3)  # -> Area, Centroid
pull_17 = PullPoint(Point=area_8.Centroid, Geometry=crv_19, ClosestOnly=True)  # -> ClosestPoint, Distance
dist_3 = Distance(PointA=pull_17.ClosestPoint, PointB=data_15)
sort_6 = SortList(Keys=dist_3)  # -> Keys, ValuesA
panel_31 = Panel(sort_6.Keys)
smaller_5 = SmallerThan(FirstNumber=dist_3, SecondNumber=Slider(200, range=0..1000))  # -> SmallerThan, OrEqualTo
dispatch_17 = Dispatch(List=geo_3, DispatchPattern=smaller_5.SmallerThan)  # -> ListA, ListB
data_27 = Data(dispatch_17.ListB)
explode_4 = Explode(Curve=data_27, Recursive=True)  # -> Segments, Vertices
len = Length(Curve=explode_4.Segments)
sort_7 = SortList(Keys=reverse(len), ValuesA=explode_4.Segments)  # -> Keys, ValuesA
item_23 = ListItem(List=sort_7.ValuesA, Index=0, Wrap=True)  # -> flatten(Item)
area_9 = Area(Geometry=data_27)  # -> Area, Centroid
midpt_9 = CurveMiddle(Curve=item_23)
move2pt_7 = MoveToPoint(Geometry=item_23, PointA=midpt_9, PointB=area_9.Centroid)  # -> Moved, Vector, Transform
end_3 = EndPoints(Curve=move2pt_7.Moved)  # -> Start, End
pull_18 = PullPoint(Point=end_3.Start, Geometry=crv_19, ClosestOnly=True)  # -> ClosestPoint, Distance
neg_2 = Negative(Value="1.5 * Pi")
crv_cp_4 = CurveClosestPoint(Point=graft(pull_18.ClosestPoint), Curve=crv_19)  # -> Point, Parameter, Distance
filter_14 = StreamFilter(Gate=Toggle(True), Stream0="1.5 * Pi", Stream1=neg_2)
eval_4 = EvaluateCurve(Curve=crv_19, Parameter=crv_cp_4.Parameter)  # -> Point, Tangent, Angle
pull_19 = PullPoint(Point=eval_4.Point, Geometry=pull_18.ClosestPoint, ClosestOnly=True)  # -> ClosestPoint, Distance
sort_8 = SortList(Keys=pull_19.Distance, ValuesA=eval_4.Point)  # -> Keys, ValuesA
sort_9 = SortList(Keys=pull_19.Distance, ValuesA=eval_4.Tangent)  # -> Keys, ValuesA
item_24 = ListItem(List=sort_9.ValuesA, Index="0", Wrap=True)
item_25 = ListItem(List=sort_8.ValuesA, Index="0", Wrap=True)
amp_11 = Amplitude(Vector=item_24, Amplitude=Slider(100, range=0..100))
move_22 = Move(Geometry=item_25, Motion=amp_11)  # -> Geometry, Transform
xy_22 = XYPlane(Origin=item_25)
rotate_10 = Rotate(Geometry=move_22.Geometry, Angle="1 * Pi", Plane=xy_22)  # -> Geometry, Transform
ln_15 = Line(StartPoint=item_25, EndPoint=rotate_10.Geometry)
crv_37 = Curve(crv_12)
rotate_11 = Rotate(Geometry=ln_15, Angle=filter_14, Plane=xy_22)  # -> Geometry, Transform

# ----
# 第二层-阴阳角
data_28 = Data(dispatch_17.ListA)
explode_5 = Explode(Curve=data_28, Recursive=True)  # -> Segments, Vertices
len_2 = Length(Curve=explode_5.Segments)
sort_10 = SortList(Keys=reverse(len_2), ValuesA=explode_5.Segments)  # -> Keys, ValuesA
item_26 = ListItem(List=sort_10.ValuesA, Index=0, Wrap=True)  # -> flatten(Item)
area_10 = Area(Geometry=data_28)  # -> Area, Centroid
midpt_10 = CurveMiddle(Curve=item_26)
move2pt_8 = MoveToPoint(Geometry=item_26, PointA=midpt_10, PointB=area_10.Centroid)  # -> Moved, Vector, Transform
end_4 = EndPoints(Curve=move2pt_8.Moved)  # -> Start, End
ln_16 = Line(StartPoint=end_4.Start, EndPoint=end_4.End)
neg_3 = Negative(Value="0.5 * Pi")
filter_15 = StreamFilter(Gate=Toggle(True), Stream0="0.5 * Pi", Stream1=neg_3)
xy_23 = XYPlane(Origin=end_4.End)
rotate_12 = Rotate(Geometry=ln_16, Angle=filter_15, Plane=xy_23)  # -> Geometry, Transform
pl_4 = ConstructPlane(Origin=end_4.End, XAxis=rotate_12.Geometry, YAxis=ln_16)

dist_4 = Distance(PointA=graft(end_4.End), PointB=item_18)
sort_11 = SortList(Keys=dist_4)  # -> Keys, ValuesA
item_27 = ListItem(List=sort_11.Keys, Index=0, Wrap=True)
smaller_6 = SmallerThan(FirstNumber=item_27, SecondNumber=Slider(100, range=0..300))  # -> SmallerThan, OrEqualTo
flatten_13 = FlattenTree(Tree=item_27, Path="{0}")
dispatch_18 = Dispatch(List=graft(pl_4), DispatchPattern=smaller_6.SmallerThan)  # -> ListA, ListB
panel_32 = Panel(flatten_13)

data_29 = Data(flatten(dispatch_18.ListA))
deplane_19 = DeconstructPlane(Plane=data_29)  # -> Origin, XAxis, YAxis, ZAxis
amp_12 = Amplitude(Vector=deplane_19.YAxis, Amplitude=Slider(300, range=0..1000))
move_23 = Move(Geometry=deplane_19.Origin, Motion=amp_12)  # -> Geometry, Transform
ln_17 = Line(StartPoint=deplane_19.Origin, EndPoint=move_23.Geometry)
midpt_11 = CurveMiddle(Curve=ln_17)
scale_9 = Scale(Geometry=ln_17, Center=midpt_11, Factor=Slider(1.5, range=0..10))  # -> Geometry, Transform
ccx_9 = CurveCurve(CurveA=graft(scale_9.Geometry), CurveB=crv_37)  # -> flatten(Points), ParamsA, ParamsB

data_30 = Data(flatten(dispatch_18.ListB))
deplane_20 = DeconstructPlane(Plane=data_30)  # -> Origin, XAxis, YAxis, ZAxis
amp_13 = Amplitude(Vector=deplane_20.YAxis, Amplitude=Slider(300, range=0..1000))
move_24 = Move(Geometry=deplane_20.Origin, Motion=amp_13)  # -> Geometry, Transform
ln_18 = Line(StartPoint=deplane_20.Origin, EndPoint=move_24.Geometry)
midpt_12 = CurveMiddle(Curve=ln_18)
scale_10 = Scale(Geometry=ln_18, Center=midpt_12, Factor=Slider(1.5, range=0..10))  # -> Geometry, Transform
ccx_10 = CurveCurve(CurveA=graft(scale_10.Geometry), CurveB=crv_37)  # -> flatten(Points), ParamsA, ParamsB

# ----
# SmoothCurve-阳角
move2pt_9 = MoveToPoint(Geometry=data_29, PointA=deplane_19.Origin, PointB=ccx_9.Points)  # -> Moved, Vector, Transform

# ----
# SmoothCurve-阴角
move2pt_10 = MoveToPoint(Geometry=data_30, PointA=deplane_20.Origin, PointB=ccx_10.Points)  # -> Moved, Vector, Transform

# ----
# SmoothCurve-正常
pl_5 = ConstructPlane(Origin=move_22.Geometry, XAxis=ln_15, YAxis=rotate_11.Geometry)

# ----
# 第二层
# 
# Curves(location point)+ Smooth Curves(architecture line)
# 第二层-区分阴阳角
area_11 = Area(Geometry=geo_5)  # -> Area, Centroid
crv_38 = Curve(crv_36)
pull_20 = PullPoint(Point=area_11.Centroid, Geometry=crv_38, ClosestOnly=True)  # -> ClosestPoint, Distance

# ----
# 第二层-阴阳角
panel_33 = Panel("0.5 * Pi")
neg_4 = Negative(Value=panel_33)
filter_16 = StreamFilter(Gate=Toggle(True), Stream0=panel_33, Stream1=neg_4)

# ----
# 第二层-大面定位
panel_34 = Panel("0.5 * Pi")
neg_5 = Negative(Value=panel_34)
filter_17 = StreamFilter(Gate=Toggle(True), Stream0=panel_34, Stream1=neg_5)

# ----
# 显示"False"时要选择线段延长
list_9 = ValueList({"线段不延长": 0, "线段延长": 1}, selected="线段延长")

filter_18 = StreamFilter(Gate=list_9, Stream0=crv_36, Stream1=ext)

disc_10 = Discontinuity(Curve=graft(filter_18), Level=1)  # -> Points, Parameters
crv_cp_5 = CurveClosestPoint(Point=disc_10.Points, Curve=graft(filter_18))  # -> Point, Parameter, Distance
eval_5 = EvaluateCurve(Curve=graft(filter_18), Parameter=crv_cp_5.Parameter)  # -> flatten(Point), Tangent, flatten(Angle)
deg_5 = Degrees(Radians=eval_5.Angle)
offset_6 = OffsetCurve(Curve=filter_18, Distance=expr("-X", filter_13), Corners=1)
panel_35 = Panel(deg_5)
larger_6 = LargerThan(FirstNumber=deg_5, SecondNumber=Slider(60, range=0..100))  # -> LargerThan, OrEqualTo
disc_11 = Discontinuity(Curve=offset_6, Level=1)  # -> flatten(Points), Parameters
dispatch_19 = Dispatch(List=eval_5.Point, DispatchPattern=larger_6.LargerThan)  # -> ListA, ListB
end_5 = EndPoints(Curve=filter_18)  # -> Start, End
data_31 = Data(dispatch_19.ListA)
pull_21 = PullPoint(Point=data_31, Geometry=flatten(offset_6), ClosestOnly=True)  # -> ClosestPoint, Distance
testpoint_5 = TestPoint(archPoint=pull_21.ClosestPoint, crvPoint=disc_11.Points)  # -> out, specialPt; inputs archPoint: list of Point3d, crvPoint: list of Point3d; same code as check_same_points

# ----
# 阴角
item_28 = ListItem(List=data_31, Index=testpoint_5.specialPt, Wrap=True)

# ----
# SmoothCurve-阴角&阳角
# 阳角
cull_i_15 = CullIndex(List=data_31, Indices=testpoint_5.specialPt, Wrap=True)

dist_5 = Distance(PointA=pull_20.ClosestPoint, PointB=data_31)
sort_12 = SortList(Keys=dist_5)  # -> Keys, ValuesA
panel_36 = Panel(sort_12.Keys)
smaller_7 = SmallerThan(FirstNumber=dist_5, SecondNumber=Slider(200, range=0..1000))  # -> SmallerThan, OrEqualTo
dispatch_20 = Dispatch(List=geo_5, DispatchPattern=smaller_7.SmallerThan)  # -> ListA, ListB
crv_39 = Curve(filter_18)

data_32 = Data(dispatch_20.ListA)
explode_6 = Explode(Curve=data_32, Recursive=True)  # -> Segments, Vertices
len_3 = Length(Curve=explode_6.Segments)
sort_13 = SortList(Keys=reverse(len_3), ValuesA=explode_6.Segments)  # -> Keys, ValuesA
item_29 = ListItem(List=sort_13.ValuesA, Index=0, Wrap=True)  # -> flatten(Item)
area_12 = Area(Geometry=data_32)  # -> Area, Centroid
midpt_13 = CurveMiddle(Curve=item_29)
move2pt_11 = MoveToPoint(Geometry=item_29, PointA=midpt_13, PointB=area_12.Centroid)  # -> Moved, Vector, Transform
end_6 = EndPoints(Curve=move2pt_11.Moved)  # -> Start, End
ln_19 = Line(StartPoint=end_6.Start, EndPoint=end_6.End)
xy_24 = XYPlane(Origin=end_6.End)
rotate_13 = Rotate(Geometry=ln_19, Angle=filter_16, Plane=xy_24)  # -> Geometry, Transform
pl_6 = ConstructPlane(Origin=end_6.End, XAxis=rotate_13.Geometry, YAxis=ln_19)

data_33 = Data(dispatch_20.ListB)
explode_7 = Explode(Curve=data_33, Recursive=True)  # -> Segments, Vertices
len_4 = Length(Curve=explode_7.Segments)
sort_14 = SortList(Keys=reverse(len_4), ValuesA=explode_7.Segments)  # -> Keys, ValuesA
item_30 = ListItem(List=sort_14.ValuesA, Index=0, Wrap=True)  # -> flatten(Item)
area_13 = Area(Geometry=data_33)  # -> Area, Centroid
midpt_14 = CurveMiddle(Curve=item_30)
move2pt_12 = MoveToPoint(Geometry=item_30, PointA=midpt_14, PointB=area_13.Centroid)  # -> Moved, Vector, Transform
end_7 = EndPoints(Curve=move2pt_12.Moved)  # -> Start, End
ln_20 = Line(StartPoint=end_7.Start, EndPoint=end_7.End)
xy_25 = XYPlane(Origin=end_7.End)
rotate_14 = Rotate(Geometry=ln_20, Angle=filter_17, Plane=xy_25)  # -> Geometry, Transform
pl_7 = ConstructPlane(Origin=end_7.End, XAxis=rotate_14.Geometry, YAxis=ln_20)

data_34 = Data(flatten(pl_7))
deplane_21 = DeconstructPlane(Plane=data_34)  # -> Origin, XAxis, YAxis, ZAxis
amp_14 = Amplitude(Vector=deplane_21.YAxis, Amplitude=Slider(300, range=0..1000))
move_25 = Move(Geometry=deplane_21.Origin, Motion=amp_14)  # -> Geometry, Transform
ln_21 = Line(StartPoint=deplane_21.Origin, EndPoint=move_25.Geometry)
midpt_15 = CurveMiddle(Curve=ln_21)
scale_11 = Scale(Geometry=ln_21, Center=midpt_15, Factor=Slider(1.5, range=0..10))  # -> Geometry, Transform
ccx_11 = CurveCurve(CurveA=scale_11.Geometry, CurveB=crv_39)  # -> Points, ParamsA, ParamsB

dist_6 = Distance(PointA=graft(end_6.End), PointB=cull_i_15)
sort_15 = SortList(Keys=dist_6)  # -> Keys, ValuesA
item_31 = ListItem(List=sort_15.Keys, Index=0, Wrap=True)
smaller_8 = SmallerThan(FirstNumber=item_31, SecondNumber=Slider(100, range=0..300))  # -> SmallerThan, OrEqualTo
flatten_14 = FlattenTree(Tree=item_31, Path="{0}")
dispatch_21 = Dispatch(List=graft(pl_6), DispatchPattern=smaller_8.SmallerThan)  # -> ListA, ListB
panel_37 = Panel(flatten_14)
flatten_15 = FlattenTree(Tree=ccx_11.Points, Path="{0}")
lng = ListLength(List=scale_11.Geometry)
lng_2 = ListLength(List=flatten_15)

data_35 = Data(flatten(dispatch_21.ListA))
deplane_22 = DeconstructPlane(Plane=data_35)  # -> Origin, XAxis, YAxis, ZAxis
amp_15 = Amplitude(Vector=deplane_22.YAxis, Amplitude=Slider(300, range=0..1000))
move_26 = Move(Geometry=deplane_22.Origin, Motion=amp_15)  # -> Geometry, Transform
ln_22 = Line(StartPoint=deplane_22.Origin, EndPoint=move_26.Geometry)
midpt_16 = CurveMiddle(Curve=ln_22)
scale_12 = Scale(Geometry=ln_22, Center=midpt_16, Factor=Slider(1.5, range=0..10))  # -> Geometry, Transform
ccx_12 = CurveCurve(CurveA=scale_12.Geometry, CurveB=crv_39)  # -> Points, ParamsA, ParamsB

data_36 = Data(flatten(dispatch_21.ListB))
deplane_23 = DeconstructPlane(Plane=data_36)  # -> Origin, XAxis, YAxis, ZAxis
amp_16 = Amplitude(Vector=deplane_23.YAxis, Amplitude=Slider(300, range=0..1000))
move_27 = Move(Geometry=deplane_23.Origin, Motion=amp_16)  # -> Geometry, Transform
ln_23 = Line(StartPoint=deplane_23.Origin, EndPoint=move_27.Geometry)
midpt_17 = CurveMiddle(Curve=ln_23)
scale_13 = Scale(Geometry=ln_23, Center=midpt_17, Factor=Slider(1.5, range=0..10))  # -> Geometry, Transform
ccx_13 = CurveCurve(CurveA=scale_13.Geometry, CurveB=crv_39)  # -> Points, ParamsA, ParamsB

equals = Equality(FirstNumber=lng, SecondNumber=lng_2)  # -> Equality, Inequality
panel_38 = Panel(equals.Equality)

# ----
# InsideCurve-阳角
move2pt_13 = MoveToPoint(Geometry=data_35, PointA=deplane_22.Origin, PointB=ccx_12.Points)  # -> Moved, Vector, Transform

# ----
# InsideCurve-阴角
move2pt_14 = MoveToPoint(Geometry=data_36, PointA=deplane_23.Origin, PointB=ccx_13.Points)  # -> Moved, Vector, Transform

# ----
# InsideCurve-大面
move2pt_15 = MoveToPoint(Geometry=data_34, PointA=flatten(deplane_21.Origin), PointB=flatten(ccx_11.Points))  # -> Moved, Vector, Transform

# ---- group: 大面
# 大面埋件布置
number_slider_5 = Slider(0.002, range=0..0.01)
filter_19 = StreamFilter(Gate=list_2, Stream0=expression_4, Stream1=number_slider_5)
filter_20 = StreamFilter(Gate=list, Stream0=filter_19, Stream1=expression_4, Stream2=filter_19)
offset_7 = OffsetCurve(Curve=offset, Distance=expr("-x", filter_20), Plane=PlaneXY(0, 0, 0), Corners=1)

# ---- group: 阴阳角区分 (continued)
crv_cp_6 = CurveClosestPoint(Point=item_9, Curve=offset_7)  # -> Point, Parameter, Distance
vec2pt_2 = Vector2Pt(PointA=crv_cp_6.Point, PointB=crv_cp.Point, Unitize=False)  # -> expr("-x", Vector), Length
angle_3 = Angle(VectorA=eval.Tangent, VectorB=vec2pt_2.Vector)  # -> Angle, Reflex
deg_6 = Degrees(Radians=angle_3.Angle)
smaller_9 = SmallerThan(FirstNumber=deg_6, SecondNumber=89)  # -> SmallerThan, OrEqualTo
dispatch_22 = Dispatch(List=item_9, DispatchPattern=smaller_9.SmallerThan)  # -> ListA, ListB

# ---- group: 正常+阳角+阴角区分 (continued)
data_37 = Data(dispatch_22.ListA)
data_38 = Data(dispatch_22.ListB)
pull_22 = PullPoint(Point=data_37, Geometry=crv_26, ClosestOnly=True)  # -> ClosestPoint, Distance
pull_23 = PullPoint(Point=data_38, Geometry=crv_27, ClosestOnly=True)  # -> ClosestPoint, Distance
c_script_3 = CSharpScript(archPoint=pull_22.ClosestPoint, crvPoint=explode_2.Vertices)  # -> out, specialPt; inputs archPoint: list of Point3d, crvPoint: list of Point3d; same code as check_same_points
c_script_4 = CSharpScript(archPoint=pull_23.ClosestPoint, crvPoint=explode_3.Vertices)  # -> out, specialPt; inputs archPoint: list of Point3d, crvPoint: list of Point3d; same code as check_same_points
cull_i_16 = CullIndex(List=data_37, Indices=c_script_3.specialPt, Wrap=True)

# ---- group: 阴角定位-细化 (continued)
dispatch_23 = Dispatch(List=item_16, DispatchPattern=smaller_9.SmallerThan)  # -> ListA, ListB
item_32 = ListItem(List=dispatch_23.ListB, Index=c_script_4.specialPt, Wrap=True)
join_2 = JoinCurves(Curves=item_32, Preserve=False)
explode_8 = Explode(Curve=join_2, Recursive=True)  # -> Segments, Vertices
crv_40 = Curve(simplify(explode_8.Segments))
len_5 = Length(Curve=crv_40)
sort_16 = SortList(Keys=len_5, ValuesA=crv_40)  # -> Keys, ValuesA
item_33 = ListItem(List=sort_16.ValuesA, Index=0, Wrap=True)  # -> Item2, Item1, Item
crv_41 = Curve([item_33.Item2, item_33.Item1])
disc_12 = Discontinuity(Curve=crv_41, Level=1)  # -> Points, Parameters
item_34 = ListItem(List=disc_12.Points, Index=0, Wrap=True)
pull_24 = PullPoint(Point=disc_12.Points, Geometry=pt_2, ClosestOnly=True)  # -> ClosestPoint, Distance
crv_cp_7 = CurveClosestPoint(Point=disc_12.Points, Curve=offset)  # -> Point, Parameter, Distance
sort_17 = SortList(Keys=pull_24.Distance, ValuesA=crv_cp_7.Point)  # -> Keys, ValuesA

# ---- group: 正常+阳角+阴角区分 / 正常-遗漏
cull_i_17 = CullIndex(List=data_38, Indices=c_script_4.specialPt, Wrap=True)

# ---- group: 正常+阳角+阴角区分 / 阴角定位点
item_35 = ListItem(List=data_38, Index=c_script_4.specialPt, Wrap=True)

# ---- group: 正常+阳角+阴角区分 / 正常定位点
merge_11 = Merge(Data1=cull_i_6, Data2=cull_i_17, Data3=cull_i_16)

# ---- group: 正常+阳角+阴角区分 / 阳角定位点
item_36 = ListItem(List=data_37, Index=c_script_3.specialPt, Wrap=True)

# ---- group: 阴角定位-细化 / 阴角-2点定位
item_37 = ListItem(List=sort_17.ValuesA, Index=0, Wrap=True)

# ----
# 阳角埋件布置
pt_11 = Point(item_36)
explode_9 = Explode(Curve=crv_22, Recursive=True)  # -> Segments, Vertices
cp_2 = ClosestPoint(Point=pt_11, Cloud=explode_9.Vertices)  # -> ClosestPoint, CPIndex, Distance
cir_3 = Circle(Plane=cp_2.ClosestPoint, Radius=Slider(150, range=0..1000))
pt_12 = Point(cp_2.ClosestPoint)
ccx_14 = CurveCurve(CurveA=cir_3, CurveB=offset)  # -> Points, ParamsA, ParamsB
item_38 = ListItem(List=ccx_14.Points, Index=0, Wrap=True)  # -> Item, Item1
ln_24 = Line(StartPoint=graft(pt_12), EndPoint=graft(item_38.Item))  # -> flatten(Line)
ln_25 = Line(StartPoint=graft(pt_12), EndPoint=graft(item_38.Item1))  # -> flatten(Line)
item_39 = ListItem(List=filter_9, Index="1", Wrap=True)
pl_8 = ConstructPlane(Origin=pt_12, XAxis=ln_24, YAxis=ln_25)
bbox_6 = BoundingBox(Content=graft(item_39), Plane=PlaneXY(0, 0, 0))  # -> Box, Box_2
srf = Surface(bbox_6.Box)
explode_10 = Explode(Curve=srf, Recursive=True)  # -> Segments, Vertices
item_40 = ListItem(List=explode_10.Vertices, Index=0, Wrap=True)  # -> Item, Item1, Item2
ln_26 = Line(StartPoint=graft(item_40.Item1), EndPoint=graft(item_40.Item2))
ln_27 = Line(StartPoint=graft(item_40.Item1), EndPoint=graft(item_40.Item))
ln_28 = Line(StartPoint=graft(item_40.Item1), EndPoint=graft(item_40.Item))
ln_29 = Line(StartPoint=graft(item_40.Item1), EndPoint=graft(item_40.Item2))
pl_9 = ConstructPlane(Origin=item_40.Item1, XAxis=ln_29, YAxis=ln_28)
pl_10 = ConstructPlane(Origin=item_40.Item1, XAxis=ln_27, YAxis=ln_26)
orient_6 = Orient(Geometry=item_39, Source=pl_10, Target=pl_8)  # -> Geometry, Transform
orient_7 = Orient(Geometry=item_39, Source=pl_9, Target=pl_8)  # -> Geometry, Transform
merge_12 = Merge(Data1=orient_6.Geometry, Data2=orient_7.Geometry)
filter_21 = StreamFilter(Gate=list_2, Stream0=orient_6.Geometry, Stream1=merge_12)
bbox_7 = BoundingBox(Content=filter_21, Plane=PlaneXY(0, 0, 0))  # -> Box, Box_2
entwine_13 = Entwine(Branch00=filter_21, Branch01=bbox_7.Box, FlattenInputs=True)
flip_3 = FlipMatrix(Data=entwine_13)
item_41 = ListItem(List=flip_3, Index=-1, Wrap=True)  # -> flatten(Item)
item_42 = ListItem(List=flip_3, Index="0", Wrap=True)  # -> flatten(Item)

# ---- group: 阴角
# 阴角埋件布置
explode_11 = Explode(Curve=crv_22, Recursive=True)  # -> Segments, Vertices
cp_3 = ClosestPoint(Point=item_35, Cloud=explode_11.Vertices)  # -> ClosestPoint, CPIndex, Distance
pshift_5 = ShiftPaths(Data=item_37, Offset=-1)
crv_cp_8 = CurveClosestPoint(Point=pshift_5, Curve=offset_7)  # -> Point, Parameter, Distance
crv_cp_9 = CurveClosestPoint(Point=pshift_5, Curve=offset)  # -> Point, Parameter, Distance
vec2pt_3 = Vector2Pt(PointA=crv_cp_8.Point, PointB=crv_cp_9.Point, Unitize=False)  # -> expr("-x", Vector), Length
eval_6 = EvaluateCurve(Curve=offset, Parameter=crv_cp_9.Parameter)  # -> Point, Tangent, Angle
pl_11 = ConstructPlane(Origin=crv_cp_9.Point, XAxis=eval_6.Tangent, YAxis=vec2pt_3.Vector)
orient_8 = Orient(Geometry=block, Source=PlaneXY(0, 0, 0), Target=pl_11)  # -> Geometry, Transform

# ---- group: 大面 (continued)
crv_cp_10 = CurveClosestPoint(Point=merge_11, Curve=offset_7)  # -> Point, Parameter, Distance
crv_cp_11 = CurveClosestPoint(Point=merge_11, Curve=offset)  # -> Point, Parameter, Distance
vec2pt_4 = Vector2Pt(PointA=crv_cp_10.Point, PointB=crv_cp_11.Point, Unitize=False)  # -> expr("-x", Vector), Length
eval_7 = EvaluateCurve(Curve=offset, Parameter=crv_cp_11.Parameter)  # -> Point, Tangent, Angle
pl_12 = ConstructPlane(Origin=crv_cp_11.Point, XAxis=eval_7.Tangent, YAxis=vec2pt_4.Vector)
orient_9 = Orient(Geometry=block, Source=PlaneXY(0, 0, 0), Target=pl_12)  # -> flatten(Geometry), Transform

# ---- group: Datea / 2
lng_3 = ListLength(List=orient_9.Geometry)
division_10 = Division(A=lng_3, B=2)
split_2 = SplitList(List=orient_9.Geometry, Index=division_10)  # -> ListA, ListB
data_39 = Data(split_2.ListA)

# ----
bbox_8 = BoundingBox(Content=data_39, Plane=PlaneXY(0, 0, 0))  # -> Box, Box_2
entwine_14 = Entwine(Branch00=data_39, Branch01=bbox_8.Box, FlattenInputs=True)
flip_4 = FlipMatrix(Data=entwine_14)
item_43 = ListItem(List=flip_4, Index=-1, Wrap=True)  # -> flatten(Item)
item_44 = ListItem(List=flip_4, Index="0", Wrap=True)  # -> flatten(Item)
阴角 = Geometry(orient_8.Geometry)

# ---- group: Monomer + Side/Top / Monomer Type
filter_22 = StreamFilter(Gate=list, Stream0=item_41, Stream1=item_41, Stream2=item_41)

# ----
# 槽埋-角部倾斜时
bbox_9 = BoundingBox(Content=item_41, Plane=PlaneXY(0, 0, 0))  # -> Box, Box_2
ln_30 = Line(StartPoint=pt_11, EndPoint=pt_12)
debrep = DeconstructBrep(Brep=bbox_9.Box)  # -> Faces, Edges, Vertices
deplane_24 = DeconstructPlane(Plane=ln_30)  # -> Origin, XAxis, YAxis, ZAxis
len_6 = Length(Curve=debrep.Edges)
sort_18 = SortList(Keys=len_6, ValuesA=debrep.Edges)  # -> Keys, reverse(ValuesA)
amp_17 = Amplitude(Vector=deplane_24.XAxis, Amplitude=Slider(63.5, range=10..100))
item_45 = ListItem(List=sort_18.ValuesA, Index=0, Wrap=True)  # -> Item, Item1, Item2
item_46 = ListItem(List=sort_18.ValuesA, Index=0, Wrap=True)
move_28 = Move(Geometry=deplane_24.Origin, Motion=amp_17)  # -> Geometry, Transform
len_7 = Length(Curve=item_46)
end_8 = EndPoints(Curve=item_45.Item2)  # -> Start, End
end_9 = EndPoints(Curve=item_45.Item1)  # -> Start, End
ln_31 = Line(StartPoint=deplane_24.Origin, EndPoint=move_28.Geometry)
ln_32 = Line(StartPoint=move_28.Geometry, EndPoint=deplane_24.Origin)
avr = Average(Input=[end_9.Start, end_9.End])
ln_33 = Line(StartPoint=end_8.Start, EndPoint=end_8.End)
ln_34 = Line(StartPoint=end_9.Start, EndPoint=avr)
c_script_5 = CSharpScript(iReset=Toggle(True), turns=Slider(30, range=0..100), steps=Slider(10, range=0..10))  # -> out, num; inputs numDefault: Double, iReset: Boolean, turns: Int32, steps: Double
# ---------- c_script_5: C# ----------
    if(iReset){
      number = 0;}

    for(int i = 0; i < turns;i++){
      number = number + steps;
      numStore.Add(number);
      Print(number.ToString());}

    num = numStore;
# ---------- c_script_5: C# additional code ----------
  double number = 0;
  List <double> numStore = new List<double>();
# ---------- end c_script_5 ----------
pl_13 = ConstructPlane(Origin=avr, XAxis=ln_34, YAxis=ln_33)
panel_39 = Panel(c_script_5.num)
amp_18 = Amplitude(Vector=ln_30, Amplitude=graft(c_script_5.num))

item_47 = ListItem(List=flatten(len_7), Index=0, Wrap=True)

ln_35 = Line(StartPoint=pt_11, EndPoint=pt_12)
move_29 = Move(Geometry=pt_12, Motion=ln_35)  # -> Geometry, Transform
ccx_15 = CurveCurve(CurveA=cir_3, CurveB=offset)  # -> Points, ParamsA, ParamsB
item_48 = ListItem(List=ccx_15.Points, Index=0, Wrap=True)  # -> flatten(Item), flatten(Item1)
ln_36 = Line(StartPoint=pt_12, EndPoint=item_48.Item)
ln_37 = Line(StartPoint=pt_12, EndPoint=move_29.Geometry)
ln_38 = Line(StartPoint=pt_12, EndPoint=item_48.Item1)
angle_4 = Angle(VectorA=ln_36, VectorB=ln_37)  # -> Angle, Reflex
angle_5 = Angle(VectorA=ln_38, VectorB=ln_37)  # -> Angle, Reflex
deg_7 = Degrees(Radians=angle_4.Angle)
deg_8 = Degrees(Radians=angle_5.Angle)
item_49 = ListItem(List=ln_37, Index=Slider(3, range=0..4), Wrap=True)
tan = Tangent(Value=degrees(deg_7))
entwine_15 = Entwine(Branch00=ln_36, Branch01=tan, FlattenInputs=True)
tan_2 = Tangent(Value=degrees(deg_8))
division_11 = Division(A=tan, B=tan_2)
panel_40 = Panel(deg_8)
panel_41 = Panel(deg_7)
addition_7 = Addition(A=division_11, B=1)
division_12 = Division(A="1", B=addition_7)
subtraction = Subtraction(A="1", B=division_12)
num = Number(division_12)
larger_7 = LargerThan(FirstNumber=tan, SecondNumber=tan_2)  # -> LargerThan, OrEqualTo

amp_19 = Amplitude(Vector=ln_32, Amplitude=expr("x/2", flatten(item_47)))
amp_20 = Amplitude(Vector=ln_31, Amplitude=expr("x/2", flatten(item_47)))
move_30 = Move(Geometry=pt_12, Motion=amp_19)  # -> Geometry, Transform
move_31 = Move(Geometry=pt_12, Motion=amp_20)  # -> Geometry, Transform
ln_39 = Line(StartPoint=move_30.Geometry, EndPoint=move_31.Geometry)

crv_42 = Curve(ln_39)
mp = Midpoint(Curve=crv_42)
eval_8 = EvaluateCurve(Curve=crv_42, Parameter=subtraction)  # -> Point, Tangent, Angle
eval_9 = EvaluateCurve(Curve=crv_42, Parameter=num)  # -> Point, Tangent, Angle
dispatch_24 = Dispatch(List=eval_8.Point, DispatchPattern=larger_7.OrEqualTo)  # -> ListA, ListB
dispatch_25 = Dispatch(List=eval_9.Point, DispatchPattern=larger_7.OrEqualTo)  # -> ListA, ListB
pt_13 = Point(dispatch_24.ListB)
pt_14 = Point(dispatch_25.ListA)
merge_13 = Merge(Data1=pt_14, Data2=pt_13)
pull_25 = PullPoint(Point=merge_13, Geometry=graft(mp), ClosestOnly=True)  # -> ClosestPoint, Distance
panel_42 = Panel(merge_13)
sort_19 = SortList(Keys=pull_25.Distance, ValuesA=merge_13)  # -> Keys, ValuesA
item_50 = ListItem(List=sort_19.ValuesA, Index=0, Wrap=True)  # -> flatten(Item)
ln_40 = Line(StartPoint=item_50, EndPoint=mp)
panel_43 = Panel(item_50)
move_32 = Move(Geometry=crv_42, Motion=ln_40)  # -> Geometry, Transform

# ---- group: 正常和阳角 - BoundingBox — 测Intersection
entwine_16 = Entwine(Branch00=flip.Curve, Branch01=offset, FlattenInputs=True)
flip_5 = FlipMatrix(Data=entwine_16)
item_51 = ListItem(List=flip_5, Index=0, Wrap=True)  # -> Item, Item1

# ----
move_33 = Move(Geometry=move_32.Geometry, Motion=amp_18)  # -> Geometry, Transform
ccx_16 = CurveCurve(CurveA=move_33.Geometry, CurveB=crv_22)  # -> Points, ParamsA, ParamsB
item_52 = ListItem(List=ccx_16.Points, Index=0, Wrap=True)
item_53 = ListItem(List=ccx_16.Points, Index="-1", Wrap=True)
pshift_6 = ShiftPaths(Data=item_52, Offset=-1)
pshift_7 = ShiftPaths(Data=item_53, Offset=-1)
flip_6 = FlipMatrix(Data=pshift_6)
flip_7 = FlipMatrix(Data=pshift_7)
pt_15 = Point(flip_6)
pt_16 = Point(flip_7)
pull_26 = PullPoint(Point=pt_15, Geometry=graft(mp), ClosestOnly=True)  # -> ClosestPoint, Distance
pull_27 = PullPoint(Point=pt_16, Geometry=graft(mp), ClosestOnly=True)  # -> ClosestPoint, Distance
sort_20 = SortList(Keys=pull_26.Distance, ValuesA=pt_15)  # -> Keys, ValuesA
sort_21 = SortList(Keys=pull_27.Distance, ValuesA=pt_16)  # -> Keys, ValuesA
item_54 = ListItem(List=sort_20.ValuesA, Index="-1", Wrap=True)
item_55 = ListItem(List=sort_21.ValuesA, Index="-1", Wrap=True)
ln_41 = Line(StartPoint=item_55, EndPoint=item_54)

end_10 = EndPoints(Curve=ln_41)  # -> Start, End

avr_2 = Average(Input=[end_10.Start, end_10.End])
pl_14 = ConstructPlane(Origin=avr_2, XAxis=ln_41, YAxis=graft(ln_30))
orient_10 = Orient(Geometry=graft(item_42), Source=pl_13, Target=pl_14)  # -> Geometry, Transform
orient_11 = Orient(Geometry=graft(item_41), Source=pl_13, Target=pl_14)  # -> Geometry, Transform

filter_23 = StreamFilter(Gate=list_8, Stream0=item_41, Stream1=orient_11.Geometry)

# ---- group: Monomer + Side/Top / Monomer Type (continued)
filter_24 = StreamFilter(Gate=list, Stream0=item_41, Stream1=filter_23, Stream2=item_41)

# ---- group: Monomer + Side/Top / Top/Side
filter_25 = StreamFilter(Gate=list_2, Stream0=filter_24, Stream1=filter_22)

# ----
filter_26 = StreamFilter(Gate=list_8, Stream0=item_42, Stream1=orient_10.Geometry)

# ---- group: 阳角分类
filter_27 = StreamFilter(Gate=list, Stream0=item_42, Stream1=filter_26, Stream2=item_42)
filter_28 = StreamFilter(Gate=list, Stream0=item_42, Stream1=item_42, Stream2=item_42)
filter_29 = StreamFilter(Gate=list_2, Stream0=filter_27, Stream1=filter_28)

# ----
阳角 = Geometry(filter_29)

# ---- group: 正常和阳角 - BoundingBox — 测Intersection (continued)
c_script_6 = CSharpScript(BrepMain=item_43, BrepStay=filter_25)  # -> out, BrepInters, BrepRemain, IndexM, IndexS; inputs BrepMain: list of Brep, BrepStay: list of Brep
# ---------- c_script_6: C# ----------
    List<Brep> BrepI = new List<Brep>();
    List<Brep> BrepR = new List<Brep>();
    List<int> num = new List<int>();
    List<int> numS = new List<int>();


    double tolr = Rhino.RhinoDoc.ActiveDoc.ModelAbsoluteTolerance;

    for(int j = 0; j < BrepMain.Count;j++){
      for(int i = 0; i < BrepStay.Count;i++){
        bool test = Rhino.Geometry.Intersect.Intersection.BrepBrep(BrepMain[j], BrepStay[i], tolr, out crv, out pts);
        if(test && crv.Length != 0){
          tryThis = true;
          numS.Add(i);
          break;}
        else{
          tryThis = false;}
      }
      if(tryThis){
        BrepI.Add(BrepMain[j]);
        num.Add(j);
      }
      else{
        BrepR.Add(BrepMain[j]);
      }
    }



    BrepInters = BrepI;
    BrepRemain = BrepR;
    IndexM = num;
    IndexS = numS;
# ---------- c_script_6: C# additional code ----------
  Rhino.Geometry.Curve[] crv;
  Rhino.Geometry.Point3d[] pts;
  bool tryThis;
# ---------- end c_script_6 ----------
item_56 = ListItem(List=item_43, Index=c_script_6.IndexM, Wrap=True)  # -> graft(Item)
item_57 = ListItem(List=filter_25, Index=c_script_6.IndexS, Wrap=True)  # -> graft(Item)
cull_i_18 = CullIndex(List=item_44, Indices=c_script_6.IndexM, Wrap=True)
item_58 = ListItem(List=item_44, Index=c_script_6.IndexM, Wrap=True)  # -> graft(Item)
area_14 = Area(Geometry=item_56)  # -> Area, Centroid
bbx = BrepBrep(BrepA=item_56, BrepB=item_57)  # -> simplify(Curves), Points
area_15 = Area(Geometry=bbx.Curves)  # -> Area, Centroid
ln_42 = Line(StartPoint=area_14.Centroid, EndPoint=area_15.Centroid)
mp_2 = Midpoint(Curve=ln_42)
scale_14 = Scale(Geometry=ln_42, Center=mp_2, Factor=Slider(1000000, range=0..1000000))  # -> Geometry, Transform
ccx_17 = CurveCurve(CurveA=scale_14.Geometry, CurveB=bbx.Curves)  # -> Points, ParamsA, ParamsB
item_59 = ListItem(List=ccx_17.Points, Index=0, Wrap=True)  # -> Item, Item1
ln_43 = Line(StartPoint=item_59.Item1, EndPoint=item_59.Item)
move_34 = Move(Geometry=item_58, Motion=ln_43)  # -> simplify(Geometry), Transform
bbox_10 = BoundingBox(Content=move_34.Geometry, Plane=PlaneXY(0, 0, 0))  # -> Box, Box_2

# ----
# 这里如果跑红也不要紧，
# 说明单体没有出现相撞的情况
area_16 = Area(Geometry=bbox_10.Box)  # -> Area, Centroid

# ---- group: 正常和阳角 - BoundingBox — 测Intersection (continued)
entwine_17 = Entwine(Branch00=move_34.Geometry, Branch01=area_16.Centroid, FlattenInputs=True)
flip_8 = FlipMatrix(Data=entwine_17)
item_60 = ListItem(List=flip_8, Index="0", Wrap=True)  # -> flatten(Item)
item_61 = ListItem(List=flip_8, Index="-1", Wrap=True)  # -> flatten(Item)
pull_28 = PullPoint(Point=item_61, Geometry=item_51.Item, ClosestOnly=True)  # -> flatten(ClosestPoint), Distance
pull_29 = PullPoint(Point=item_61, Geometry=item_51.Item1, ClosestOnly=True)  # -> flatten(ClosestPoint), Distance
vec2pt_5 = Vector2Pt(PointA=item_61, PointB=pull_28.ClosestPoint, Unitize=False)  # -> Vector, Length
vec2pt_6 = Vector2Pt(PointA=item_61, PointB=pull_29.ClosestPoint, Unitize=False)  # -> Vector, Length
multiplication_13 = Multiplication(A=vec2pt_5.Vector, B=vec2pt_6.Vector)
larger_8 = LargerThan(FirstNumber=multiplication_13, SecondNumber=0)  # -> LargerThan, OrEqualTo
dispatch_26 = Dispatch(List=item_60, DispatchPattern=larger_8.LargerThan)  # -> ListA, ListB

# ---- group: Normal
geo_7 = Geometry(cull_i_18)

# ---- group: Normal-Move
移动 = Geometry(dispatch_26.ListA)

# ----
# PLAN Results
merge_14 = Merge(Data1=geo_7, Data2=阳角, Data3=移动, Data4=阴角)

# ==== cluster Cluster
G = ClusterInput()
rotate = Rotate(Geometry=G, Angle=3.141592654, Plane=PlaneXY(0, 0, 0))  # -> Geometry, Transform
boxprop = BoxProperties(Box=rotate.Geometry)  # -> Center, Diagonal, Area, Volume, Degeneracy
bbox = BoundingBox(Content=rotate.Geometry, Plane=PlaneXY(0, 0, 0))  # -> Box, Box_2
debox = DeconstructBox(Box=bbox.Box)  # -> Plane, X, Y, Z
pdecon = Deconstruct(Point=boxprop.Center)  # -> XComponent, YComponent, ZComponent
dedomain = DeconstructDomain(Domain=debox.Y)  # -> Start, End
pt = ConstructPoint(XCoordinate=pdecon.XComponent, YCoordinate=dedomain.Start, ZCoordinate=pdecon.ZComponent)
xy = XYPlane(Origin=Point(0, 0, 0))
pl_origin = PlaneOrigin(Base=xy, Origin=pt)
orient = Orient(Geometry=rotate.Geometry, Source=pl_origin, Target=xy)  # -> Geometry, Transform
G_2 = ClusterOutput(orient.Geometry)
